# Grasshopper definition 01 Dynamic Brick Wall.gh (Grasshopper 1.0.7)
# plug-ins: LunchBox, Bifocals

number_slider = Slider(6, range=0..10)
number_slider_2 = Slider(30, range=0..50)
number_slider_3 = Slider(2, range=0..10)
pt = ConstructPoint(XCoordinate=0, YCoordinate=0, ZCoordinate=0)
Y = UnitY(Factor=Slider(20, range=0..20))
Z = UnitZ(Factor=Slider(10, range=0..20))
xz = XZPlane(Origin=Point(0, 0, 0))
number_slider_4 = Slider(50, range=0..1000)
number_slider_5 = Slider(50, range=0..1000)
number_slider_6 = Slider(31, range=0..100)
number_slider_7 = Slider(30, range=0..100)
move = Move(Geometry=pt, Motion=Y)  # -> Geometry, Transform
recgrid = Rectangular(Plane=xz, SizeX=number_slider, SizeY=number_slider_3, ExtentX=number_slider_2, ExtentY=number_slider_2)  # -> Cells, Points
move_2 = Move(Geometry=move.Geometry, Motion=Z)  # -> Geometry, Transform
move_3 = Move(Geometry=pt, Motion=Z)  # -> Geometry, Transform
rectangle = Rectangle(Plane=PlaneXY(0, 0, 0), XSize=number_slider_5, YSize=number_slider_4, Radius=0)  # -> Rectangle, Length
addition = Addition(A=number_slider_5, B=Slider(50, range=0..100))
Z_2 = UnitZ(Factor=Slider(100, range=0..100))
addition_2 = Addition(A=number_slider_4, B=Slider(10, range=0..10))
number_slider_8 = Slider(20, range=0..100)
offset = OffsetCurve(Curve=recgrid.Cells, Distance=expr("-x", Slider(0.1, range=0..0.1)), Corners=1)
extr = Extrude(Base=rectangle.Rectangle, Direction=Z_2)
rectangle_2 = Rectangle(Plane=PlaneXY(0, 0, 0), XSize=addition, YSize=addition_2, Radius=0)  # -> Rectangle, Length
srf4pt = _4PointSurface(CornerA=pt, CornerB=move.Geometry, CornerC=move_2.Geometry, CornerD=move_3.Geometry)
sqgrid = Square(Plane=PlaneXY(0, 0, 0), Size=1, ExtentX=number_slider_6, ExtentY=number_slider_7)  # -> Cells, Points
arrrec = RectangularArray(Geometry=extr, Cell=rectangle_2.Rectangle, XCount=number_slider_6, YCount=number_slider_7)  # -> Geometry, Transform
scale_nu = ScaleNU(Geometry=sqgrid.Points, Plane=PlaneXY(0, 0, 0), ScaleX=number_slider_8, ScaleY=number_slider_8, ScaleZ=1)  # -> flatten(Geometry), Transform
panel = Panel(scale_nu.Geometry)
runion = RegionUnion(Curves=flatten(recgrid.Cells))
pshift = ShiftPaths(Data=offset, Offset=-1)
panel_2 = Panel(pshift)
image = ImageSampler(scale_nu.Geometry, Filter="Value", Interpolate=False, Umax=1, Umin=0, Vmax=1, Vmin=0, Wrap=1)
simplify = SimplifyCurve(Curve=runion)  # -> Curve, Simplified
quadstag = StaggeredQuadPanels(Surface=srf4pt, UDivisions=Slider(20, range=0..20), VDivisions=Slider(20, range=0..20))
panel_3 = Panel("""0
2""")
boxrec = BoxRectangle(Rectangle=pshift, Height=number_slider_3)  # -> simplify(Box)
explode = Explode(Curve=simplify.Curve, Recursive=True)  # -> Segments, Vertices
panel_4 = Panel(boxrec)
area = Area(Geometry=arrrec.Geometry)  # -> Area, Centroid
bnd = Bounds(Numbers=image)
pt_2 = Point(Point(7.220446079, 9.943105365, 5.50438733))
flip = FlipMatrix(Data=boxrec)
X = UnitX(Factor=Slider(0.5, range=0..1))
item = ListItem(List=explode.Segments, Index=panel_3, Wrap=True)
Y_2 = UnitY(Factor=area.Centroid)
division = Division(A=number_slider, B="2")
extr_2 = Extrude(Base=quadstag, Direction=X)
remap = RemapNumbers(Value=image, Source=bnd, Target=Slider(90, range=0..100))  # -> Mapped, Clipped
midpt = CurveMiddle(Curve=item)
split = SplitTree(Data=flip, Masks=flatten("{0,2,...}"))  # -> Positive, Negative
X_2 = UnitX(Factor=division)
panel_5 = Panel(flip)
move_4 = Move(Geometry=split.Negative, Motion=X_2)  # -> Geometry, Transform
rot3d = Rotate3D(Geometry=arrrec.Geometry, Angle=flatten(degrees(remap.Mapped)), Center=area.Centroid, Axis=Y_2)  # -> Geometry, Transform
box = EvaluateBox(Box=extr_2, UParameter=0.5, VParameter=0.5, WParameter=0.5)  # -> Plane, Point, Include
pline = PolyLine(Vertices=midpt, Closed=False)
pull = PullPoint(Point=box.Point, Geometry=pt_2, ClosestOnly=True)  # -> ClosestPoint, Distance
merge = Merge(Data1=split.Positive, Data2=move_4.Geometry)
scale = Scale(Geometry=extr_2, Center=box.Point, Factor=Slider(0.95, range=0..1))  # -> Geometry, Transform
cap = CapHoles(Brep=rot3d.Geometry)
min = Minimum(A=pull.Distance, B=Slider(10, range=0..10))
deplane = DeconstructPlane(Plane=box.Plane)  # -> Origin, XAxis, YAxis, ZAxis
area_2 = Area(Geometry=merge)  # -> Area, Centroid
list = ValueList({"Line": 0, "Point": 1}, selected="Point")
dom = ConstructDomain(DomainStart=Slider(25, range=0..90), DomainEnd=Slider(5, range=0..90))
bnd_2 = Bounds(Numbers=min)
padjust = AdjustPlane(Plane=box.Plane, Normal=deplane.ZAxis)
eval = EvaluateCurve(Curve=reparameterize(pline), Parameter=Slider(0.499, range=0..1))  # -> Point, Tangent, Angle
remap_2 = RemapNumbers(Value=min, Source=bnd_2, Target=dom)  # -> Mapped, Clipped
filter = StreamFilter(Gate=list, Stream0=pline, Stream1=eval.Point)
pull_2 = PullPoint(Point=area_2.Centroid, Geometry=filter, ClosestOnly=True)  # -> ClosestPoint, Distance
sort = SortList(Keys=flatten(pull_2.Distance))  # -> reverse(Keys), ValuesA
rotate = Rotate(Geometry=scale.Geometry, Angle=degrees(remap_2.Mapped), Plane=padjust)  # -> Geometry, Transform
item_2 = ListItem(List=sort.Keys, Index=0, Wrap=True)
multiplication = Multiplication(A=item_2, B=Slider(0.305, range=0.001..1))
neg = Negative(Value=Slider(0.144, range=0..1))
min_2 = Minimum(A=pull_2.Distance, B=multiplication)
pi = Pi(Factor=neg)
bnd_3 = Bounds(Numbers=min_2)
dom_2 = ConstructDomain(DomainStart=pi, DomainEnd="0")
remap_3 = RemapNumbers(Value=min_2, Source=bnd_3, Target=dom_2)  # -> Mapped, Clipped
rotate_2 = Rotate(Geometry=merge, Angle=remap_3.Mapped, Plane=area_2.Centroid)  # -> Geometry, Transform
