# Grasshopper definition 1104.gh (Grasshopper 1.0.7)

panel = Panel("SPINE")
panel_2 = Panel("V")
panel_3 = Panel("H")
bone_start = Slider(51, range=0..200)
number_slider = Slider(1, range=0..10)
bone_end = Slider(20, range=0..200)
bone_end_2 = Slider(93, range=0..1000)
bone_start_2 = Slider(611, range=0..1000)
number_slider_2 = Slider(5, range=0..10)
radius = Slider(1500, range=0..10000)
height = Slider(1500, range=0..10000)
number_slider_3 = Slider(0.4, range=0..1)
bone_thickness_h = Slider(10, range=0..100)
spine_thickness = Slider(2.273, range=0..10)
number_slider_4 = Slider(1, range=0..10)
bone_end_3 = Slider(150, range=0..1000)
bone_start_3 = Slider(364, range=0..1000)
swatch = ColourSwatch(SwatchColor=RGB(164, 146, 171))
panel_4 = Panel("BASE CURVE")
multiplication = Multiplication(A=bone_thickness_h, B=spine_thickness)
bone_number = Slider(450, range=0..1000)
pi = Pi(Factor=Slider(5, range=0..10))
range = Range(Domain=pi, Steps=bone_number)
range_2 = Range(Domain=height, Steps=bone_number)
sin = Sine(Value=range)
cos = Cosine(Value=range)
pi_number = Slider(5, range=1..10)
shape_factor = Slider(1, range=0..10)
bone_number_2 = Slider(450, range=0..1000)
radius_2 = Slider(1500, range=0..10000)
height_2 = Slider(1500, range=0..10000)
multiplication_2 = Multiplication(A=sin, B=radius)
multiplication_3 = Multiplication(A=cos, B=radius)
pt = ConstructPoint(XCoordinate=multiplication_2, YCoordinate=multiplication_3, ZCoordinate=range_2)
range_3 = Range(Domain=Slider(1, range=1..10), Steps=bone_number)
graph = GraphMapper(
    range_3,
    x0=0,
    x1=1,
    y0=0,
    y1=1,
    container_name="Sine Summation",
    Equation0_px=[0.1181818172, 0.3090909123],
    Equation0_py=[0.2775330544, 0.4273127913],
    Equation1_px=[0.6121212244, 1],
    Equation1_py=[0.2422907352, 0.4405286312])
pi_2 = Pi(Factor=pi_number)
bnd = Bounds(Numbers=graph)
dom = ConstructDomain(DomainStart=Slider(0.85, range=0..1), DomainEnd=Slider(1.25, range=0..10))
range_4 = Range(Domain=pi_2, Steps=bone_number_2)
range_5 = Range(Domain=height_2, Steps=bone_number_2)
remap = RemapNumbers(Value=graph, Source=bnd, Target=dom)  # -> Mapped, Clipped
cos_2 = Cosine(Value=range_4)
sin_2 = Sine(Value=range_4)
scale_nu = ScaleNU(Geometry=pt, Plane=PlaneXY(0, 0, 0), ScaleX=remap.Mapped, ScaleY=remap.Mapped, ScaleZ=1)  # -> Geometry, Transform
multiplication_4 = Multiplication(A=cos_2, B=radius_2)
multiplication_5 = Multiplication(A=sin_2, B=radius_2)
pt_2 = ConstructPoint(XCoordinate=multiplication_5, YCoordinate=multiplication_4, ZCoordinate=range_5)
range_6 = Range(Domain=shape_factor, Steps=bone_number_2)
graph_2 = GraphMapper(
    range_6,
    x0=0,
    x1=1,
    y0=0,
    y1=1,
    container_name="Sine Summation",
    Equation0_px=[0.1181818172, 0.3090909123],
    Equation0_py=[0.2775330544, 0.4273127913],
    Equation1_px=[0.6121212244, 1],
    Equation1_py=[0.2422907352, 0.4405286312])
bnd_2 = Bounds(Numbers=graph_2)
dom_2 = ConstructDomain(DomainStart=Slider(0.85, range=0..1), DomainEnd=Slider(1.25, range=0..10))
pdecon = Deconstruct(Point=scale_nu.Geometry)  # -> XComponent, YComponent, ZComponent
range_7 = Range(Domain=number_slider_4, Steps=bone_number)
range_8 = Range(Domain=number_slider_4, Steps=bone_number)
remap_2 = RemapNumbers(Value=graph_2, Source=bnd_2, Target=dom_2)  # -> Mapped, Clipped
graph_3 = GraphMapper(range_7, x0=0, x1=1, y0=0, y1=1, container_name="Sine", Equation_px=[0, 1], Equation_py=[0, 1])
graph_4 = GraphMapper(range_8, x0=0, x1=1, y0=0, y1=1, container_name="Sine", Equation_px=[0, 1], Equation_py=[0, 1])
scale_nu_2 = ScaleNU(Geometry=pt_2, Plane=PlaneXY(0, 0, 0), ScaleX=remap_2.Mapped, ScaleY=remap_2.Mapped, ScaleZ=1)  # -> Geometry, Transform
range_9 = Range(Domain=number_slider, Steps=bone_number)
range_10 = Range(Domain=number_slider, Steps=bone_number)
graph_factor = Slider(1, range=1..10)
bnd_3 = Bounds(Numbers=graph_3)
bnd_4 = Bounds(Numbers=graph_4)
dom_3 = ConstructDomain(DomainStart=bone_end_3, DomainEnd=bone_start_3)
dom_4 = ConstructDomain(DomainStart=bone_end_3, DomainEnd=bone_start_3)
graph_5 = GraphMapper(
    range_9,
    x0=0,
    x1=1,
    y0=0,
    y1=1,
    container_name="Sinc",
    Equation_X0=0.5,
    Equation_X1=0.6,
    Equation_Y0=0.8,
    Equation_Y1=0.3)
graph_6 = GraphMapper(
    range_10,
    x0=0,
    x1=1,
    y0=0,
    y1=1,
    container_name="Sine Summation",
    Equation0_px=[0.2, 0.3],
    Equation0_py=[0.2, 0.3],
    Equation1_px=[0.6666666865, 0.9],
    Equation1_py=[0.3348017335, 0.5])
range_11 = Range(Domain=number_slider_2, Steps=bone_number)
range_12 = Range(Domain=number_slider_2, Steps=bone_number)
remap_3 = RemapNumbers(Value=graph_3, Source=bnd_3, Target=dom_3)  # -> Mapped, Clipped
remap_4 = RemapNumbers(Value=graph_4, Source=bnd_4, Target=dom_4)  # -> Mapped, Clipped
amp = Amplitude(Vector=scale_nu.Geometry, Amplitude=expr("-x", remap_4.Mapped))
graph_7 = GraphMapper(
    range_12,
    x0=0,
    x1=1,
    y0=0,
    y1=1,
    container_name="Sine Summation",
    Equation0_px=[0.2121212184, 0.324242413],
    Equation0_py=[0.2026431561, 0.2951542139],
    Equation1_px=[0.5969697237, 0.9030302763],
    Equation1_py=[0.1894273162, 0.3832598925])
graph_8 = GraphMapper(
    range_11,
    x0=0,
    x1=1,
    y0=0,
    y1=1,
    container_name="Sine Summation",
    Equation0_px=[0.2, 0.3],
    Equation0_py=[0.2, 0.3],
    Equation1_px=[0.6303419471, 0.9],
    Equation1_py=[0.4056798816, 0.5])
bnd_5 = Bounds(Numbers=graph_5)
dom_5 = ConstructDomain(DomainStart=bone_end, DomainEnd=bone_start)
bnd_6 = Bounds(Numbers=graph_6)
dom_6 = ConstructDomain(DomainStart=bone_end, DomainEnd=bone_start)
amp_2 = Amplitude(Vector=scale_nu.Geometry, Amplitude=remap_3.Mapped)
range_13 = Range(Domain=graph_factor, Steps=bone_number_2)
remap_5 = RemapNumbers(Value=graph_5, Source=bnd_5, Target=dom_5)  # -> Mapped, Clipped
remap_6 = RemapNumbers(Value=graph_6, Source=bnd_6, Target=dom_6)  # -> Mapped, Clipped
move = Move(Geometry=scale_nu.Geometry, Motion=amp_2)  # -> Geometry, Transform
move_2 = Move(Geometry=scale_nu.Geometry, Motion=amp)  # -> Geometry, Transform
graph_9 = GraphMapper(range_13, x0=0, x1=1, y0=0, y1=1, container_name="Sine", Equation_px=[0, 0.2831559479], Equation_py=[0, 1])
bnd_7 = Bounds(Numbers=graph_7)
dom_7 = ConstructDomain(DomainStart=bone_end_2, DomainEnd=bone_start_2)
bnd_8 = Bounds(Numbers=graph_8)
dom_8 = ConstructDomain(DomainStart=bone_end_2, DomainEnd=bone_start_2)
amp_3 = Amplitude(Vector=scale_nu.Geometry, Amplitude=expr("-X", remap_5.Mapped))
amp_4 = Amplitude(Vector=scale_nu.Geometry, Amplitude=remap_6.Mapped)
remap_7 = RemapNumbers(Value=graph_7, Source=bnd_7, Target=dom_7)  # -> Mapped, Clipped
remap_8 = RemapNumbers(Value=graph_8, Source=bnd_8, Target=dom_8)  # -> Mapped, Clipped
pdecon_2 = Deconstruct(Point=move.Geometry)  # -> XComponent, YComponent, ZComponent
pdecon_3 = Deconstruct(Point=move_2.Geometry)  # -> XComponent, YComponent, ZComponent
bnd_9 = Bounds(Numbers=graph_9)
dom_9 = ConstructDomain(DomainStart=Slider(150, range=0..1000), DomainEnd=Slider(350, range=0..1000))
move_3 = Move(Geometry=scale_nu.Geometry, Motion=amp_3)  # -> Geometry, Transform
move_4 = Move(Geometry=scale_nu.Geometry, Motion=amp_4)  # -> Geometry, Transform
Z = UnitZ(Factor=expr("-x", remap_7.Mapped))
Z_2 = UnitZ(Factor=expr("-x", remap_8.Mapped))
remap_9 = RemapNumbers(Value=graph_9, Source=bnd_9, Target=dom_9)  # -> Mapped, Clipped
pt_3 = ConstructPoint(XCoordinate=pdecon_2.XComponent, YCoordinate=pdecon_2.YComponent, ZCoordinate=pdecon.ZComponent)
sph = Sphere(Base=[pt_3, scale_nu.Geometry], Radius=Slider(18, range=0..50))
pt_4 = ConstructPoint(XCoordinate=pdecon_3.XComponent, YCoordinate=pdecon_3.YComponent, ZCoordinate=pdecon.ZComponent)
ln = Line(StartPoint=scale_nu.Geometry, EndPoint=pt_3)
ln_2 = Line(StartPoint=scale_nu.Geometry, EndPoint=pt_4)
pdecon_4 = Deconstruct(Point=move_3.Geometry)  # -> XComponent, YComponent, ZComponent
pdecon_5 = Deconstruct(Point=move_4.Geometry)  # -> XComponent, YComponent, ZComponent
amp_5 = Amplitude(Vector=scale_nu_2.Geometry, Amplitude=remap_9.Mapped)
neg = Negative(Value=amp_5)
Z_3 = UnitZ(Factor=Slider(10, range=0..10))
pt_5 = ConstructPoint(XCoordinate=pdecon_4.XComponent, YCoordinate=pdecon_4.YComponent, ZCoordinate=pdecon.ZComponent)
pt_6 = ConstructPoint(XCoordinate=pdecon_5.XComponent, YCoordinate=pdecon_5.YComponent, ZCoordinate=pdecon.ZComponent)
move_5 = Move(Geometry=scale_nu_2.Geometry, Motion=amp_5)  # -> Geometry, Transform
move_6 = Move(Geometry=scale_nu_2.Geometry, Motion=neg)  # -> Geometry, Transform
move_7 = Move(Geometry=scale_nu.Geometry, Motion=Z_3)  # -> Geometry, Transform
pdecon_6 = Deconstruct(Point=move_5.Geometry)  # -> XComponent, YComponent, ZComponent
pdecon_7 = Deconstruct(Point=scale_nu_2.Geometry)  # -> XComponent, YComponent, ZComponent
pdecon_8 = Deconstruct(Point=move_6.Geometry)  # -> XComponent, YComponent, ZComponent
pdecon_9 = Deconstruct(Point=scale_nu_2.Geometry)  # -> XComponent, YComponent, ZComponent
move_8 = Move(Geometry=pt_3, Motion=Z)  # -> Geometry, Transform
move_9 = Move(Geometry=pt_4, Motion=Z_2)  # -> Geometry, Transform
eval = EvaluateCurve(Curve=ln, Parameter=number_slider_3)  # -> Point, Tangent, Angle
eval_2 = EvaluateCurve(Curve=ln_2, Parameter=number_slider_3)  # -> Point, Tangent, Angle
pt_7 = ConstructPoint(XCoordinate=pdecon_6.XComponent, YCoordinate=pdecon_6.YComponent, ZCoordinate=pdecon_7.ZComponent)
pt_8 = ConstructPoint(XCoordinate=pdecon_8.XComponent, YCoordinate=pdecon_8.YComponent, ZCoordinate=pdecon_9.ZComponent)
merge = Merge(Data1=graft(pt_5), Data2=graft(move_7.Geometry), Data3=graft(pt_6))
range_14 = Range(Domain=graph_factor, Steps=bone_number_2)
intcrv = Interpolate(Vertices=merge, Degree=3, Periodic=False, KnotStyle=1)  # -> Curve, Length, Domain
graph_10 = GraphMapper(
    range_14,
    x0=0,
    x1=1,
    y0=0,
    y1=1,
    container_name="Sine Summation",
    Equation0_px=[0.2121212184, 0.324242413],
    Equation0_py=[0.2026431561, 0.2951542139],
    Equation1_px=[0.5969697237, 0.9030302763],
    Equation1_py=[0.1894273162, 0.3832598925])
dom_10 = ConstructDomain(DomainStart=Slider(150, range=0..1000), DomainEnd=Slider(600, range=0..1000))
bnd_10 = Bounds(Numbers=graph_10)
remap_10 = RemapNumbers(Value=graph_10, Source=bnd_10, Target=dom_10)  # -> Mapped, Clipped
Z_4 = UnitZ(Factor=expr("-x", remap_10.Mapped))
merge_2 = Merge(Data1=graft(pt_6), Data2=graft(eval.Point), Data3=graft(move_8.Geometry))
merge_3 = Merge(Data1=graft(pt_5), Data2=graft(eval_2.Point), Data3=graft(move_9.Geometry))
number_slider_5 = Slider(0.1, range=0..1)
intcrv_2 = Interpolate(Vertices=merge_2, Degree=3, Periodic=False, KnotStyle=1)  # -> Curve, Length, Domain
intcrv_3 = Interpolate(Vertices=merge_3, Degree=3, Periodic=False, KnotStyle=1)  # -> Curve, Length, Domain
amp_6 = Amplitude(Vector=intcrv_2.Curve, Amplitude=expr("-x", multiplication))
amp_7 = Amplitude(Vector=intcrv_2.Curve, Amplitude=multiplication)
move_10 = Move(Geometry=pt_8, Motion=Z_4)  # -> Geometry, Transform
move_11 = Move(Geometry=pt_7, Motion=Z_4)  # -> Geometry, Transform
move_12 = Move(Geometry=intcrv.Curve, Motion=amp_7)  # -> Geometry, Transform
move_13 = Move(Geometry=intcrv.Curve, Motion=amp_6)  # -> Geometry, Transform
ln_3 = Line(StartPoint=scale_nu_2.Geometry, EndPoint=pt_8)
ln_4 = Line(StartPoint=scale_nu_2.Geometry, EndPoint=pt_7)
amp_8 = Amplitude(Vector=intcrv_2.Curve, Amplitude=expr("-x", bone_thickness_h))
amp_9 = Amplitude(Vector=intcrv_2.Curve, Amplitude=expr("-x", bone_thickness_h))
amp_10 = Amplitude(Vector=intcrv_2.Curve, Amplitude=bone_thickness_h)
amp_11 = Amplitude(Vector=intcrv_2.Curve, Amplitude=bone_thickness_h)
eval_3 = EvaluateCurve(Curve=ln_3, Parameter=number_slider_5)  # -> Point, Tangent, Angle
eval_4 = EvaluateCurve(Curve=ln_4, Parameter=number_slider_5)  # -> Point, Tangent, Angle
rulesrf = RuledSurface(CurveA=move_12.Geometry, CurveB=move_13.Geometry)
move_14 = Move(Geometry=intcrv_2.Curve, Motion=amp_10)  # -> Geometry, Transform
move_15 = Move(Geometry=intcrv_2.Curve, Motion=amp_8)  # -> Geometry, Transform
move_16 = Move(Geometry=intcrv_3.Curve, Motion=amp_11)  # -> Geometry, Transform
move_17 = Move(Geometry=intcrv_3.Curve, Motion=amp_9)  # -> Geometry, Transform

panel_5 = Panel("""0
1""")  # disabled
dispatch = Dispatch(List=flatten(intcrv_2.Curve), DispatchPattern=panel_5)  # -> ListA, ListB; disabled
dispatch_2 = Dispatch(List=flatten(intcrv_3.Curve), DispatchPattern=panel_5)  # -> ListA, ListB; disabled
geo = Geometry(dispatch_2.ListB)  # disabled
geo_2 = Geometry(dispatch.ListA)  # disabled
amp_12 = Amplitude(Vector=geo_2, Amplitude=expr("-x", bone_thickness_h))  # disabled
amp_13 = Amplitude(Vector=geo_2, Amplitude=bone_thickness_h)  # disabled
amp_14 = Amplitude(Vector=geo, Amplitude=expr("-x", bone_thickness_h))  # disabled
amp_15 = Amplitude(Vector=geo, Amplitude=bone_thickness_h)  # disabled
move_18 = Move(Geometry=geo_2, Motion=amp_13)  # -> Geometry, Transform; disabled
move_19 = Move(Geometry=geo_2, Motion=amp_12)  # -> Geometry, Transform; disabled
move_20 = Move(Geometry=geo, Motion=amp_15)  # -> Geometry, Transform; disabled
move_21 = Move(Geometry=geo, Motion=amp_14)  # -> Geometry, Transform; disabled
rulesrf_2 = RuledSurface(CurveA=move_18.Geometry, CurveB=move_19.Geometry)  # disabled
rulesrf_3 = RuledSurface(CurveA=move_20.Geometry, CurveB=move_21.Geometry)  # disabled

merge_4 = Merge(Data1=graft(scale_nu_2.Geometry), Data2=graft(eval_3.Point), Data3=graft(move_10.Geometry))
merge_5 = Merge(Data1=graft(scale_nu_2.Geometry), Data2=graft(eval_4.Point), Data3=graft(move_11.Geometry))
rulesrf_4 = RuledSurface(CurveA=move_14.Geometry, CurveB=move_15.Geometry)
rulesrf_5 = RuledSurface(CurveA=move_16.Geometry, CurveB=move_17.Geometry)
intcrv_4 = Interpolate(Vertices=merge_4, Degree=3, Periodic=False, KnotStyle=1)  # -> Curve, Length, Domain
intcrv_5 = Interpolate(Vertices=merge_5, Degree=3, Periodic=False, KnotStyle=1)  # -> Curve, Length, Domain
preview = CustomPreview(Geometry=rulesrf, Material=ColourSwatch(SwatchColor=RGBA(60, 73, 93, 50)))
preview_2 = CustomPreview(Geometry=rulesrf_5, Material=swatch)
preview_3 = CustomPreview(Geometry=rulesrf_4, Material=swatch)

number_slider_6 = Slider(1, range=0..10)  # disabled
bone_end_4 = Slider(462, range=0..1000)  # disabled
spine_length = Slider(5000, range=0..10000)  # disabled
number_slider_7 = Slider(1, range=0..10)  # disabled
bone_end_5 = Slider(550, range=0..1000)  # disabled
bone_start_4 = Slider(146, range=0..1000)  # disabled
number_slider_8 = Slider(0.57, range=0..1)  # disabled
bone_thickness = Slider(1.7, range=0..10)  # disabled
number_slider_9 = Slider(6.514, range=0..10)  # disabled
thickness_height = Slider(1.2, range=0..5)  # disabled
number_slider_10 = Slider(2, range=0..10)  # disabled
spine_end = Slider(55, range=0..100)  # disabled
spine_start = Slider(7, range=0..100)  # disabled
bone_start_5 = Slider(63, range=0..1000)  # disabled
bone_number_3 = Slider(200, range=0..1000)  # disabled
multiplication_6 = Multiplication(A=bone_thickness, B=number_slider_9)  # disabled
pt_9 = ConstructPoint(XCoordinate=0, YCoordinate=0, ZCoordinate=0)  # disabled
X = UnitX(Factor=1)  # disabled
line = LineSDL(Start=pt_9, Direction=X, Length=spine_length)  # disabled
divide = DivideCurve(Curve=line, Count=bone_number_3, Kinks=False)  # -> Points, Tangents, Parameters; disabled
range_15 = Range(Domain=number_slider_6, Steps=bone_number_3)  # disabled
range_16 = Range(Domain=number_slider_7, Steps=bone_number_3)  # disabled
range_17 = Range(Domain=number_slider_10, Steps=bone_number_3)  # disabled
graph_11 = GraphMapper(range_15, x0=0, x1=1, y0=0, y1=1, container_name="Sine", Equation_px=[0, 0.6839273572], Equation_py=[0, 0.9905284643])  # disabled
graph_12 = GraphMapper(range_16, x0=0, x1=1, y0=0, y1=1, container_name="Sine", Equation_px=[0, 1], Equation_py=[0, 1])  # disabled
graph_13 = GraphMapper(
    range_17,
    x0=0,
    x1=1,
    y0=0,
    y1=1,
    A=1,
    B=0,
    container_name="Linear",
    Graph_x0=0.25,
    Graph_x1=0.75,
    Graph_y0=0.25,
    Graph_y1=0.75)  # disabled
bnd_11 = Bounds(Numbers=graph_11)  # disabled
dom_11 = ConstructDomain(DomainStart=bone_end_4, DomainEnd=bone_start_5)  # disabled
bnd_12 = Bounds(Numbers=graph_12)  # disabled
dom_12 = ConstructDomain(DomainStart=bone_end_5, DomainEnd=bone_start_4)  # disabled
bnd_13 = Bounds(Numbers=graph_13)  # disabled
dom_13 = ConstructDomain(DomainStart=spine_end, DomainEnd=spine_start)  # disabled
remap_11 = RemapNumbers(Value=graph_11, Source=bnd_11, Target=dom_11)  # -> Mapped, Clipped; disabled
remap_12 = RemapNumbers(Value=graph_12, Source=bnd_12, Target=dom_12)  # -> Mapped, Clipped; disabled
remap_13 = RemapNumbers(Value=graph_13, Source=bnd_13, Target=dom_13)  # -> Mapped, Clipped; disabled
Z_5 = UnitZ(Factor=expr("-X", remap_11.Mapped))  # disabled
Y = UnitY(Factor=remap_12.Mapped)  # disabled
Y_2 = UnitY(Factor=remap_13.Mapped)  # disabled
move_22 = Move(Geometry=divide.Points, Motion=Y_2)  # -> Geometry, Transform; disabled
move_23 = Move(Geometry=divide.Points, Motion=Y)  # -> Geometry, Transform; disabled
ln_5 = Line(StartPoint=divide.Points, EndPoint=move_23.Geometry)  # disabled
move_24 = Move(Geometry=move_23.Geometry, Motion=Z_5)  # -> Geometry, Transform; disabled
eval_5 = EvaluateCurve(Curve=ln_5, Parameter=number_slider_8)  # -> Point, Tangent, Angle; disabled
merge_6 = Merge(Data1=graft(move_22.Geometry), Data2=graft(eval_5.Point), Data3=graft(move_24.Geometry))  # disabled
intcrv_6 = Interpolate(Vertices=merge_6, Degree=3, Periodic=False, KnotStyle=1)  # -> Curve, Length, Domain; disabled
ln_6 = Line(StartPoint=divide.Points, EndPoint=move_22.Geometry)  # disabled
X_2 = UnitX(Factor=bone_thickness)  # disabled
X_3 = UnitX(Factor=multiplication_6)  # disabled
move_25 = Move(Geometry=intcrv_6.Curve, Motion=expr("-X", X_2))  # -> Geometry, Transform; disabled
move_26 = Move(Geometry=ln_6, Motion=expr("-X", X_3))  # -> Geometry, Transform; disabled
move_27 = Move(Geometry=intcrv_6.Curve, Motion=X_2)  # -> Geometry, Transform; disabled
move_28 = Move(Geometry=ln_6, Motion=X_3)  # -> Geometry, Transform; disabled
rulesrf_6 = RuledSurface(CurveA=move_28.Geometry, CurveB=move_26.Geometry)  # disabled
rulesrf_7 = RuledSurface(CurveA=move_27.Geometry, CurveB=move_25.Geometry)  # disabled
xz = XZPlane(Origin=Point(0, 0, 0))  # disabled
mirror = Mirror(Geometry=rulesrf_7, Plane=xz)  # -> Geometry, Transform; disabled
mirror_2 = Mirror(Geometry=rulesrf_6, Plane=xz)  # -> Geometry, Transform; disabled
planar = IsPlanar(Surface=rulesrf_7, Interior=True)  # -> Planar, Plane; disabled
amp_16 = Amplitude(Vector=planar.Plane, Amplitude=thickness_height)  # disabled
move_29 = Move(Geometry=rulesrf_7, Motion=amp_16)  # -> Geometry, Transform; disabled
extr = Extrude(Base=move_29.Geometry, Direction=expr("-x*2", amp_16))  # disabled
