# Grasshopper definition 12344.gh (Grasshopper 1.0.7)

panel = Panel("SPINE")
panel_2 = Panel("V")
panel_3 = Panel("H")
bone_start = Slider(51, range=0..200)
number_slider = Slider(1, range=0..10)
bone_end = Slider(20, range=0..200)
bone_end_2 = Slider(93, range=0..1000)
bone_start_2 = Slider(611, range=0..1000)
number_slider_2 = Slider(5, range=0..10)
bone_number = Slider(450, range=0..1000)
radius = Slider(1500, range=0..10000)
height = Slider(1500, range=0..10000)
number_slider_3 = Slider(0.4, range=0..1)
bone_thickness_h = Slider(10, range=0..100)
spine_thickness = Slider(2.273, range=0..10)
number_slider_4 = Slider(1, range=0..10)
bone_end_3 = Slider(150, range=0..1000)
bone_start_3 = Slider(364, range=0..1000)
number_slider_5 = Slider(1, range=0..10)  # disabled
bone_end_4 = Slider(462, range=0..1000)  # disabled
bone_start_4 = Slider(63, range=0..1000)  # disabled
spine_length = Slider(5000, range=0..10000)  # disabled
bone_number_2 = Slider(200, range=0..1000)  # disabled
number_slider_6 = Slider(1, range=0..10)  # disabled
bone_end_5 = Slider(550, range=0..1000)  # disabled
bone_start_5 = Slider(146, range=0..1000)  # disabled
number_slider_7 = Slider(0.57, range=0..1)  # disabled
bone_thickness = Slider(1.7, range=0..10)  # disabled
number_slider_8 = Slider(6.514, range=0..10)  # disabled
thickness_height = Slider(1.2, range=0..5)  # disabled
number_slider_9 = Slider(2, range=0..10)  # disabled
spine_end = Slider(55, range=0..100)  # disabled
spine_start = Slider(7, range=0..100)  # disabled
swatch = ColourSwatch(SwatchColor=RGB(164, 146, 171))
panel_4 = Panel("BASE CURVE")
multiplication = Multiplication(A=bone_thickness, B=number_slider_8)  # disabled
pt = ConstructPoint(XCoordinate=0, YCoordinate=0, ZCoordinate=0)  # disabled
multiplication_2 = Multiplication(A=bone_thickness_h, B=spine_thickness)
X = UnitX(Factor=1)  # disabled
pi = Pi(Factor=Slider(5, range=0..10))
line = LineSDL(Start=pt, Direction=X, Length=spine_length)  # disabled
range = Range(Domain=pi, Steps=bone_number)
range_2 = Range(Domain=height, Steps=bone_number)
divide = DivideCurve(Curve=line, Count=bone_number_2, Kinks=False)  # -> Points, Tangents, Parameters; disabled
range_3 = Range(Domain=number_slider_5, Steps=bone_number_2)  # disabled
range_4 = Range(Domain=number_slider_6, Steps=bone_number_2)  # disabled
range_5 = Range(Domain=number_slider_9, Steps=bone_number_2)  # disabled
sin = Sine(Value=range)
cos = Cosine(Value=range)
graph = GraphMapper(range_3, x0=0, x1=1, y0=0, y1=1, container_name="Sine", Equation_px=[0, 0.6839273572], Equation_py=[0, 0.9905284643])  # disabled
graph_2 = GraphMapper(range_4, x0=0, x1=1, y0=0, y1=1, container_name="Sine", Equation_px=[0, 1], Equation_py=[0, 1])  # disabled
graph_3 = GraphMapper(
    range_5,
    x0=0,
    x1=1,
    y0=0,
    y1=1,
    A=1,
    B=0,
    container_name="Linear",
    Graph_x0=0.25,
    Graph_x1=0.75,
    Graph_y0=0.25,
    Graph_y1=0.75)  # disabled
multiplication_3 = Multiplication(A=sin, B=radius)
multiplication_4 = Multiplication(A=cos, B=radius)
bnd = Bounds(Numbers=graph)  # disabled
dom = ConstructDomain(DomainStart=bone_end_4, DomainEnd=bone_start_4)  # disabled
bnd_2 = Bounds(Numbers=graph_2)  # disabled
dom_2 = ConstructDomain(DomainStart=bone_end_5, DomainEnd=bone_start_5)  # disabled
bnd_3 = Bounds(Numbers=graph_3)  # disabled
dom_3 = ConstructDomain(DomainStart=spine_end, DomainEnd=spine_start)  # disabled
pt_2 = ConstructPoint(XCoordinate=multiplication_3, YCoordinate=multiplication_4, ZCoordinate=range_2)
range_6 = Range(Domain=Slider(1, range=1..10), Steps=bone_number)
remap = RemapNumbers(Value=graph, Source=bnd, Target=dom)  # -> Mapped, Clipped; disabled
remap_2 = RemapNumbers(Value=graph_2, Source=bnd_2, Target=dom_2)  # -> Mapped, Clipped; disabled
remap_3 = RemapNumbers(Value=graph_3, Source=bnd_3, Target=dom_3)  # -> Mapped, Clipped; disabled
graph_4 = GraphMapper(
    range_6,
    x0=0,
    x1=1,
    y0=0,
    y1=1,
    container_name="Sine Summation",
    Equation0_px=[0.1181818172, 0.3090909123],
    Equation0_py=[0.2775330544, 0.4273127913],
    Equation1_px=[0.6121212244, 1],
    Equation1_py=[0.2422907352, 0.4405286312])
Z = UnitZ(Factor=expr("-X", remap.Mapped))  # disabled
Y = UnitY(Factor=remap_2.Mapped)  # disabled
Y_2 = UnitY(Factor=remap_3.Mapped)  # disabled
move = Move(Geometry=divide.Points, Motion=Y_2)  # -> Geometry, Transform; disabled
move_2 = Move(Geometry=divide.Points, Motion=Y)  # -> Geometry, Transform; disabled
bnd_4 = Bounds(Numbers=graph_4)
dom_4 = ConstructDomain(DomainStart=Slider(0.85, range=0..1), DomainEnd=Slider(1.25, range=0..10))
ln = Line(StartPoint=divide.Points, EndPoint=move_2.Geometry)  # disabled
remap_4 = RemapNumbers(Value=graph_4, Source=bnd_4, Target=dom_4)  # -> Mapped, Clipped
move_3 = Move(Geometry=move_2.Geometry, Motion=Z)  # -> Geometry, Transform; disabled
eval = EvaluateCurve(Curve=ln, Parameter=number_slider_7)  # -> Point, Tangent, Angle; disabled
scale_nu = ScaleNU(Geometry=pt_2, Plane=PlaneXY(0, 0, 0), ScaleX=remap_4.Mapped, ScaleY=remap_4.Mapped, ScaleZ=1)  # -> Geometry, Transform
merge = Merge(Data1=graft(move.Geometry), Data2=graft(eval.Point), Data3=graft(move_3.Geometry))  # disabled
intcrv = Interpolate(Vertices=merge, Degree=3, Periodic=False, KnotStyle=1)  # -> Curve, Length, Domain; disabled
ln_2 = Line(StartPoint=divide.Points, EndPoint=move.Geometry)  # disabled
X_2 = UnitX(Factor=bone_thickness)  # disabled
X_3 = UnitX(Factor=multiplication)  # disabled
move_4 = Move(Geometry=intcrv.Curve, Motion=expr("-X", X_2))  # -> Geometry, Transform; disabled
move_5 = Move(Geometry=ln_2, Motion=expr("-X", X_3))  # -> Geometry, Transform; disabled
intcrv_2 = Interpolate(Vertices=scale_nu.Geometry, Degree=3, Periodic=False, KnotStyle=1)  # -> Curve, Length, Domain
move_6 = Move(Geometry=intcrv.Curve, Motion=X_2)  # -> Geometry, Transform; disabled
move_7 = Move(Geometry=ln_2, Motion=X_3)  # -> Geometry, Transform; disabled
pdecon = Deconstruct(Point=scale_nu.Geometry)  # -> XComponent, YComponent, ZComponent
rulesrf = RuledSurface(CurveA=move_7.Geometry, CurveB=move_5.Geometry)  # disabled
rulesrf_2 = RuledSurface(CurveA=move_6.Geometry, CurveB=move_4.Geometry)  # disabled
xz = XZPlane(Origin=Point(0, 0, 0))  # disabled
range_7 = Range(Domain=number_slider_4, Steps=bone_number)
range_8 = Range(Domain=number_slider_4, Steps=bone_number)
graph_5 = GraphMapper(range_7, x0=0, x1=1, y0=0, y1=1, container_name="Sine", Equation_px=[0, 1], Equation_py=[0, 1])
graph_6 = GraphMapper(range_8, x0=0, x1=1, y0=0, y1=1, container_name="Sine", Equation_px=[0, 1], Equation_py=[0, 1])
mirror = Mirror(Geometry=rulesrf_2, Plane=xz)  # -> Geometry, Transform; disabled
mirror_2 = Mirror(Geometry=rulesrf, Plane=xz)  # -> Geometry, Transform; disabled
range_9 = Range(Domain=number_slider, Steps=bone_number)
range_10 = Range(Domain=number_slider, Steps=bone_number)
bnd_5 = Bounds(Numbers=graph_5)
bnd_6 = Bounds(Numbers=graph_6)
dom_5 = ConstructDomain(DomainStart=bone_end_3, DomainEnd=bone_start_3)
dom_6 = ConstructDomain(DomainStart=bone_end_3, DomainEnd=bone_start_3)
graph_7 = GraphMapper(
    range_9,
    x0=0,
    x1=1,
    y0=0,
    y1=1,
    container_name="Sinc",
    Equation_X0=0.5,
    Equation_X1=0.6,
    Equation_Y0=0.8,
    Equation_Y1=0.3)
graph_8 = GraphMapper(
    range_10,
    x0=0,
    x1=1,
    y0=0,
    y1=1,
    container_name="Sine Summation",
    Equation0_px=[0.2, 0.3],
    Equation0_py=[0.2, 0.3],
    Equation1_px=[0.6666666865, 0.9],
    Equation1_py=[0.3348017335, 0.5])
range_11 = Range(Domain=number_slider_2, Steps=bone_number)
graph_9 = GraphMapper(
    range_11,
    x0=0,
    x1=1,
    y0=0,
    y1=1,
    container_name="Sine Summation",
    Equation0_px=[0.2121212184, 0.324242413],
    Equation0_py=[0.2026431561, 0.2951542139],
    Equation1_px=[0.5969697237, 0.9030302763],
    Equation1_py=[0.1894273162, 0.3832598925])
range_12 = Range(Domain=number_slider_2, Steps=bone_number)
graph_10 = GraphMapper(
    range_12,
    x0=0,
    x1=1,
    y0=0,
    y1=1,
    container_name="Sine Summation",
    Equation0_px=[0.2, 0.3],
    Equation0_py=[0.2, 0.3],
    Equation1_px=[0.6303419471, 0.9],
    Equation1_py=[0.4056798816, 0.5])
remap_5 = RemapNumbers(Value=graph_5, Source=bnd_5, Target=dom_5)  # -> Mapped, Clipped
remap_6 = RemapNumbers(Value=graph_6, Source=bnd_6, Target=dom_6)  # -> Mapped, Clipped
amp = Amplitude(Vector=scale_nu.Geometry, Amplitude=expr("-x", remap_6.Mapped))
bnd_7 = Bounds(Numbers=graph_7)
dom_7 = ConstructDomain(DomainStart=bone_end, DomainEnd=bone_start)
bnd_8 = Bounds(Numbers=graph_8)
dom_8 = ConstructDomain(DomainStart=bone_end, DomainEnd=bone_start)
amp_2 = Amplitude(Vector=scale_nu.Geometry, Amplitude=remap_5.Mapped)
remap_7 = RemapNumbers(Value=graph_7, Source=bnd_7, Target=dom_7)  # -> Mapped, Clipped
remap_8 = RemapNumbers(Value=graph_8, Source=bnd_8, Target=dom_8)  # -> Mapped, Clipped
move_8 = Move(Geometry=scale_nu.Geometry, Motion=amp_2)  # -> Geometry, Transform
move_9 = Move(Geometry=scale_nu.Geometry, Motion=amp)  # -> Geometry, Transform
bnd_9 = Bounds(Numbers=graph_9)
dom_9 = ConstructDomain(DomainStart=bone_end_2, DomainEnd=bone_start_2)
bnd_10 = Bounds(Numbers=graph_10)
dom_10 = ConstructDomain(DomainStart=bone_end_2, DomainEnd=bone_start_2)
planar = IsPlanar(Surface=rulesrf_2, Interior=True)  # -> Planar, Plane; disabled
amp_3 = Amplitude(Vector=scale_nu.Geometry, Amplitude=expr("-X", remap_7.Mapped))
amp_4 = Amplitude(Vector=scale_nu.Geometry, Amplitude=remap_8.Mapped)
remap_9 = RemapNumbers(Value=graph_9, Source=bnd_9, Target=dom_9)  # -> Mapped, Clipped
remap_10 = RemapNumbers(Value=graph_10, Source=bnd_10, Target=dom_10)  # -> Mapped, Clipped
pdecon_2 = Deconstruct(Point=move_8.Geometry)  # -> XComponent, YComponent, ZComponent
pdecon_3 = Deconstruct(Point=move_9.Geometry)  # -> XComponent, YComponent, ZComponent
amp_5 = Amplitude(Vector=planar.Plane, Amplitude=thickness_height)  # disabled
move_10 = Move(Geometry=scale_nu.Geometry, Motion=amp_3)  # -> Geometry, Transform
move_11 = Move(Geometry=scale_nu.Geometry, Motion=amp_4)  # -> Geometry, Transform
Z_2 = UnitZ(Factor=expr("-x", remap_9.Mapped))
Z_3 = UnitZ(Factor=expr("-x", remap_10.Mapped))
move_12 = Move(Geometry=rulesrf_2, Motion=amp_5)  # -> Geometry, Transform; disabled
pt_3 = ConstructPoint(XCoordinate=pdecon_2.XComponent, YCoordinate=pdecon_2.YComponent, ZCoordinate=pdecon.ZComponent)
sph = Sphere(Base=[pt_3, scale_nu.Geometry], Radius=Slider(18, range=0..50))
pt_4 = ConstructPoint(XCoordinate=pdecon_3.XComponent, YCoordinate=pdecon_3.YComponent, ZCoordinate=pdecon.ZComponent)
ln_3 = Line(StartPoint=scale_nu.Geometry, EndPoint=pt_3)
ln_4 = Line(StartPoint=scale_nu.Geometry, EndPoint=pt_4)
pdecon_4 = Deconstruct(Point=move_10.Geometry)  # -> XComponent, YComponent, ZComponent
pdecon_5 = Deconstruct(Point=move_11.Geometry)  # -> XComponent, YComponent, ZComponent
extr = Extrude(Base=move_12.Geometry, Direction=expr("-x*2", amp_5))  # disabled
Z_4 = UnitZ(Factor=Slider(10, range=0..10))
intcrv_3 = Interpolate(Vertices=pt_3, Degree=3, Periodic=False, KnotStyle=1)  # -> Curve, Length, Domain
pt_5 = ConstructPoint(XCoordinate=pdecon_4.XComponent, YCoordinate=pdecon_4.YComponent, ZCoordinate=pdecon.ZComponent)
pt_6 = ConstructPoint(XCoordinate=pdecon_5.XComponent, YCoordinate=pdecon_5.YComponent, ZCoordinate=pdecon.ZComponent)
move_13 = Move(Geometry=scale_nu.Geometry, Motion=Z_4)  # -> Geometry, Transform
move_14 = Move(Geometry=pt_3, Motion=Z_2)  # -> Geometry, Transform
move_15 = Move(Geometry=pt_4, Motion=Z_3)  # -> Geometry, Transform
eval_2 = EvaluateCurve(Curve=ln_3, Parameter=number_slider_3)  # -> Point, Tangent, Angle
eval_3 = EvaluateCurve(Curve=ln_4, Parameter=number_slider_3)  # -> Point, Tangent, Angle
merge_2 = Merge(Data1=graft(pt_5), Data2=graft(move_13.Geometry), Data3=graft(pt_6))
intcrv_4 = Interpolate(Vertices=merge_2, Degree=3, Periodic=False, KnotStyle=1)  # -> Curve, Length, Domain
merge_3 = Merge(Data1=graft(pt_6), Data2=graft(eval_2.Point), Data3=graft(move_14.Geometry))
merge_4 = Merge(Data1=graft(pt_5), Data2=graft(eval_3.Point), Data3=graft(move_15.Geometry))
intcrv_5 = Interpolate(Vertices=merge_3, Degree=3, Periodic=False, KnotStyle=1)  # -> Curve, Length, Domain
intcrv_6 = Interpolate(Vertices=merge_4, Degree=3, Periodic=False, KnotStyle=1)  # -> Curve, Length, Domain
amp_6 = Amplitude(Vector=intcrv_5.Curve, Amplitude=expr("-x", multiplication_2))
amp_7 = Amplitude(Vector=intcrv_5.Curve, Amplitude=multiplication_2)
move_16 = Move(Geometry=intcrv_4.Curve, Motion=amp_7)  # -> Geometry, Transform
move_17 = Move(Geometry=intcrv_4.Curve, Motion=amp_6)  # -> Geometry, Transform
amp_8 = Amplitude(Vector=intcrv_5.Curve, Amplitude=expr("-x", bone_thickness_h))
amp_9 = Amplitude(Vector=intcrv_5.Curve, Amplitude=expr("-x", bone_thickness_h))
amp_10 = Amplitude(Vector=intcrv_5.Curve, Amplitude=bone_thickness_h)
amp_11 = Amplitude(Vector=intcrv_5.Curve, Amplitude=bone_thickness_h)
rulesrf_3 = RuledSurface(CurveA=move_16.Geometry, CurveB=move_17.Geometry)
move_18 = Move(Geometry=intcrv_5.Curve, Motion=amp_10)  # -> Geometry, Transform
move_19 = Move(Geometry=intcrv_5.Curve, Motion=amp_8)  # -> Geometry, Transform
move_20 = Move(Geometry=intcrv_6.Curve, Motion=amp_11)  # -> Geometry, Transform
move_21 = Move(Geometry=intcrv_6.Curve, Motion=amp_9)  # -> Geometry, Transform

panel_5 = Panel("""0
1""")  # disabled
dispatch = Dispatch(List=flatten(intcrv_5.Curve), DispatchPattern=panel_5)  # -> ListA, ListB; disabled
dispatch_2 = Dispatch(List=flatten(intcrv_6.Curve), DispatchPattern=panel_5)  # -> ListA, ListB; disabled
geo = Geometry(dispatch_2.ListB)  # disabled
geo_2 = Geometry(dispatch.ListA)  # disabled
amp_12 = Amplitude(Vector=geo_2, Amplitude=expr("-x", bone_thickness_h))  # disabled
amp_13 = Amplitude(Vector=geo_2, Amplitude=bone_thickness_h)  # disabled
amp_14 = Amplitude(Vector=geo, Amplitude=expr("-x", bone_thickness_h))  # disabled
amp_15 = Amplitude(Vector=geo, Amplitude=bone_thickness_h)  # disabled
move_22 = Move(Geometry=geo_2, Motion=amp_13)  # -> Geometry, Transform; disabled
move_23 = Move(Geometry=geo_2, Motion=amp_12)  # -> Geometry, Transform; disabled
move_24 = Move(Geometry=geo, Motion=amp_15)  # -> Geometry, Transform; disabled
move_25 = Move(Geometry=geo, Motion=amp_14)  # -> Geometry, Transform; disabled
rulesrf_4 = RuledSurface(CurveA=move_22.Geometry, CurveB=move_23.Geometry)  # disabled
rulesrf_5 = RuledSurface(CurveA=move_24.Geometry, CurveB=move_25.Geometry)  # disabled

rulesrf_6 = RuledSurface(CurveA=move_18.Geometry, CurveB=move_19.Geometry)
rulesrf_7 = RuledSurface(CurveA=move_20.Geometry, CurveB=move_21.Geometry)
preview = CustomPreview(Geometry=rulesrf_3, Material=ColourSwatch(SwatchColor=RGBA(60, 73, 93, 50)))
preview_2 = CustomPreview(Geometry=rulesrf_7, Material=swatch)
preview_3 = CustomPreview(Geometry=rulesrf_6, Material=swatch)
