# Grasshopper definition SVG DEMO.gh (Grasshopper 1.0.8)
# plug-ins: Redback-Beta.GH

panel = Panel("*all")
panel_2 = Panel("broad rules")
panel_3 = Panel("sepecific rules")
panel_4 = Panel("""*{
fill: none;
stroke: #e31212;
stroke-width: 0.1mm;
stroke-linejoin: round;
}

[layer="Default"]{
stroke-width: 0.25mm;
stroke-dasharray: 0.5mm 0.1mm;
}

[layer="Layer 02"]{
stroke-width: 0.5mm;
fill: #7a5f5f;
}""")
cyl = Cylinder(Base=PlaneXY(0, 0, 0), Radius=0.5, Length=1)
panel_5 = Panel("""*{
fill: none;
stroke: #e31212;
stroke-width: 0.1mm;
stroke-linejoin: round;
}

[layer="Default"]{
stroke-width: 0.25mm;
stroke-dasharray: 0.5mm 0.1mm;
}

[layer="Layer 02"]{
stroke-width: 0.5mm;
fill: #7a5f5f;
}""")
panel_6 = Panel("""Default
Layer 01
Layer 02""")
area = Area(Geometry=cyl)  # -> Area, Centroid
viewports = QueryViewports(AutoUpdateState=True)
# use plug in
# human
# dynamic geo pipeline
objects = QueryModelObjects(Layer=panel_6, Locked=True, Hidden=True, AutoUpdateState=True)
panel_7 = Panel("""Default
Layer 01
Layer 02""")
srf = Surface(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)
pt = ConstructPoint(XCoordinate=0, YCoordinate=0, ZCoordinate=0)
scale = Scale(Geometry=cyl, Center=area.Centroid, Factor=Slider(1000, range=0..1000))  # -> Geometry, Transform
item = ListItem(List=viewports, Index=0, Wrap=True)
view = View(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, ViewSource=1)
object = ModelObject(Object=objects)  # -> Object, Geometry, Layer
evalsrf = EvaluateSurface(Surface=srf, Point=pt)  # -> Point, Normal, UDirection, VDirection, Frame
objects_2 = QueryModelObjects(Layer=panel_7, Locked=True, Hidden=True, AutoUpdateState=True)
make2d = Make2D(Geometry=scale.Geometry, View=view, TangentEdges=False, TangentSeams=False, AutoComputeMake2D=False)  # -> VisibleCurves, VisibleIndex, VisibleType, HiddenCurves, HiddenIndex, HiddenType
layer = ModelLayer(Layer=object.Layer)  # -> Layer, Name
bbox = BoundingBox(Content=srf, Plane=evalsrf.Frame)  # -> Box, Box_2
crv = Curve(object.Geometry)
path = FilePath("C:\Users\ypan7056\Pictures\Screenshot 2024-09-16 115638.png")

panel_8 = Panel("420,297")
xy = XYPlane(Origin=Point(0, 0, 0))
svg_layout = SVGLayout(Plane=xy, Dimensions="A3 (L)", Scale="1:100", Location=Toggle(True))  # -> L, R

object_2 = ModelObject(Object=objects_2)  # -> Object, Geometry, Layer
panel_9 = Panel(layer.Name)
geo2arch = Geo2Arch(Geometry=flatten(make2d.VisibleCurves), Properties=flatten("{}"))
panel_10 = Panel(path)
debox = DeconstructBox(Box=bbox.Box)  # -> Plane, X, Y, Z
json = CreateJSON(Keys="layer", Values=graft(layer.Name))
layer_2 = ModelLayer(Layer=object_2.Layer)  # -> Layer, Name
rectangle = Rectangle(Plane=debox.Plane, XSize=debox.X, YSize=debox.Y, Radius=0)  # -> Rectangle, Length
topoly = CurveToPolyline(Curve=crv, ToleranceDistance="0.01", ToleranceAngle=0)  # -> Polyline, Segments

xy_2 = XYPlane(Origin=Point(0, 0, 0))
svg_layout_2 = SVGLayout(Plane=xy_2, Dimensions="A3 (L)", Scale="1:100", Location=Toggle(True))  # -> L, R

crv_2 = Curve(object_2.Geometry)

xy_3 = XYPlane(Origin=Point(0, 0, 0))
svg_layout_3 = SVGLayout(Plane=xy_3, Dimensions="A3 (L)", Scale="1:100", Location=Toggle(True))  # -> L, R

image_object = ImageObject(RE=rectangle.Rectangle, ImagePath=panel_10)
svg = SVGGenerator(JO=geo2arch, LA=svg_layout.L, CSS=panel_5)
geo2arch_2 = Geo2Arch(Geometry=flatten(topoly.Polyline), Properties=flatten(json))
json_2 = CreateJSON(Keys="layer", Values=graft(layer_2.Name))
topoly_2 = CurveToPolyline(Curve=crv_2, ToleranceDistance="0.01", ToleranceAngle=0)  # -> Polyline, Segments
geo2arch_3 = Geo2Arch(Geometry=image_object, Properties="{}")
panel_11 = Panel(layer_2.Name)
mergearchjson = MergeArchJSON(AJ=flatten([geo2arch_2, geo2arch]))
unflatten = UnflattenTree(Tree=json_2, Guide=topoly_2.Polyline)

rel_path = RelativePath(Path=Toggle(False), RelativePath="MAKE 2D DEMO.SVG")  # -> FullPath, Directory, FileName
write = WriteFile(Run=Toggle(True), Content=svg, FileDirectory=rel_path.Directory, FileName=rel_path.FileName)
panel_12 = Panel(write)

svg_2 = SVGGenerator(JO=geo2arch_3, LA=svg_layout_2.L)

rel_path_2 = RelativePath(Path=Toggle(False), RelativePath="pic DEMO.SVG")  # -> FullPath, Directory, FileName
write_2 = WriteFile(Run=Toggle(True), Content=svg_2, FileDirectory=rel_path_2.Directory, FileName=rel_path_2.FileName)
panel_13 = Panel(write_2)

svg_3 = SVGGenerator(JO=geo2arch_2, LA=svg_layout.L, CSS=panel_5)

rel_path_3 = RelativePath(Path=Toggle(False), RelativePath="SVG DEMO.SVG")  # -> FullPath, Directory, FileName
write_3 = WriteFile(Run=Toggle(True), Content=svg_3, FileDirectory=rel_path_3.Directory, FileName=rel_path_3.FileName)
panel_14 = Panel(write_3)

item_2 = ListItem(List=layer_2.Name, Index=0, Wrap=True)
geo2arch_4 = Geo2Arch(Geometry=topoly_2.Polyline, Properties=unflatten)
panel_15 = Panel(item_2)
rep = ReplaceText(Text="SVG DEMO_#.SVG", Find="#", Replace=item_2, RecursiveReplace=False)
svg_4 = SVGGenerator(JO=geo2arch_4, LA=svg_layout_3.L, CSS=panel_4)
rel_path_4 = RelativePath(Path=Toggle(False), RelativePath=rep)  # -> FullPath, Directory, FileName
write_4 = WriteFile(Run=Toggle(True), Content=svg_4, FileDirectory=rel_path_4.Directory, FileName=rel_path_4.FileName)
panel_16 = Panel(write_4)
