# Grasshopper definition 29 7 2024.ghx (Grasshopper 1.0.7)
# plug-ins: Bifocals

pt = Point(Point(-62.90705533, 60.55848072, 0))
crv = Curve(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)
crv_2 = Curve([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])
pt_2 = Point([Point(-60.15768169, 42.14383568, 0), Point(-64.64938468, 52.43328387, 0), Point(-68.66378649, 37.1359904, 0), Point(-74.39266142, 46.82945609, 0), Point(-76.54099329, 57.7760444, 0), Point(-87.85623432, 51.51556268, 0), Point(-84.56368467, 38.11349442, 0), Point(-62.90705533, 60.55848072, 0), Point(-53.72501548, 32.96598723, 0)])

dom = ConstructDomain(DomainStart=Slider(2, range=0..10), DomainEnd=Slider(7, range=0..20))
lng = ListLength(List=pt_2)
random = Random(Range=dom, Number=lng, Seed=2)  # -> graft(Random)

graft = GraftTree(Tree=pt_2, IncludeEmptyLists=True, IncludeNullItems=True)
Z = UnitZ(Factor=Slider(5, range=0..100))
loft = Loft(Curves=crv_2, Options={Adjust=False, Closed=False, LoftEnds=0, LoftSimp=0, LoftType=0, Rebuild=10, Refit=0.01})
extr = Extrude(Base=crv, Direction=Z)
extr_2 = Extrude(Base=crv_2, Direction=Z)
sph = Sphere(Base=pt, Radius=1)
panel = Panel(sph)
panel_2 = Panel(extr)
panel_3 = Panel(extr_2)
panel_4 = Panel(loft)
lng_2 = ListLength(List=pt_2)
circle = CircleCNR(Center=graft, Normal=Vector(0, 0, 1), Radius=random)
division = Division(A=random, B=Slider(5, range=0..10))
panel_5 = Panel(lng_2)
circle_2 = CircleCNR(Center=graft, Normal=Vector(0, 0, 1), Radius=division)
eval = EvaluateCurve(Curve=reparameterize(circle), Parameter=[Slider(0.44, range=0..1), Slider(0.55, range=0..1)])  # -> Point, Tangent, Angle
ln = Line(StartPoint=graft, EndPoint=eval.Point)
trim = TrimWithRegions(Curve=ln, Regions=circle_2)  # -> Inside, Outside
crv_3 = Curve(trim.Outside)
pshift = ShiftPaths(Data=crv_3, Offset="-1")
random_2 = Random(Range=Slider(360, range=0..1000), Number=panel_5, Seed=Slider(5, range=0..10))  # -> graft(Random)
rotate = Rotate(Geometry=pshift, Angle=degrees(random_2), Plane=graft)  # -> Geometry, Transform
