# Grasshopper definition 3.14.gh (Grasshopper 1.0.7)

crv = Curve(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)  # disabled
crv_2 = Curve(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)  # disabled
crv_3 = Curve(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)  # disabled
number_slider = Slider(46, range=0..50)  # disabled
number_slider_2 = Slider(15, range=0..50)  # disabled
number_slider_3 = Slider(10, range=0..50)  # disabled
number_slider_4 = Slider(1, range=0..10)  # disabled
loft = Loft(
    Curves=[crv, crv_2, crv_3],
    Options={Adjust=False, Closed=False, LoftEnds=0, LoftSimp=0, LoftType=0, Rebuild=10, Refit=0.01})  # disabled
offset = OffsetSurface(Surface=loft, Distance=expr("-x", number_slider), Retrim=True)  # disabled
sdivide = DivideSurface(Surface=loft, UCount=number_slider_2, VCount=number_slider_3)  # -> Points, Normals, Parameters; disabled
sdivide_2 = DivideSurface(Surface=offset, UCount=number_slider_2, VCount=number_slider_3)  # -> Points, Normals, Parameters; disabled
ln = Line(StartPoint=sdivide.Points, EndPoint=sdivide_2.Points)  # disabled
pipe = Pipe(Curve=ln, Radius=number_slider_4, Caps=1)  # disabled
swatch = ColourSwatch(SwatchColor=RGB(255, 255, 255))  # disabled
preview = CustomPreview(Geometry=pipe, Material=swatch)  # disabled

pt = Point(Point(-17.10650675, 9.568692019, 0))  # disabled
grid_size = Slider(30, range=1..30)  # disabled
number_slider_5 = Slider(5, range=0..10)  # disabled
number_slider_6 = Slider(16, range=1..100)  # disabled
sqgrid = Square(Plane=PlaneXY(0, 0, 0), Size=grid_size, ExtentX=5, ExtentY=5)  # -> Cells, Points; disabled
dist = Distance(PointA=pt, PointB=sqgrid.Points)  # disabled
division = Division(A=dist, B=number_slider_6)  # disabled
polygon = Polygon(Plane=sqgrid.Points, Radius=division, Segments=number_slider_5, FilletRadius=0)  # -> Polygon, Length; disabled
Z = UnitZ(Factor=division)  # disabled
extr = Extrude(Base=polygon.Polygon, Direction=Z)  # disabled
cap = CapHoles(Brep=extr)  # disabled

panel = Panel("x*sin(5*x)")  # disabled
number_slider_7 = Slider(0, range=0..100)  # disabled
number_slider_8 = Slider(10, range=0..10)  # disabled
number_slider_9 = Slider(100, range=0..100)  # disabled
number_slider_10 = Slider(4.1, range=0..10)  # disabled
number_slider_11 = Slider(9, range=0..10)  # disabled
panel_2 = Panel("x*cos(5*x)")  # disabled
dom = ConstructDomain(DomainStart=number_slider_7, DomainEnd=number_slider_8)  # disabled
range = Range(Domain=dom, Steps=number_slider_9)  # disabled
eval = Evaluate(F=panel, x=range)  # disabled
eval_2 = Evaluate(F=panel_2, x=range)  # disabled
pt_2 = ConstructPoint(XCoordinate=eval, YCoordinate=eval_2, ZCoordinate=0)  # disabled
voronoi = Voronoi(Points=pt_2, Radius=number_slider_10, BruteForceOverride=False)  # disabled
area = Area(Geometry=voronoi)  # -> Area, Centroid; disabled
division_2 = Division(A=area.Area, B=number_slider_11)  # disabled
Z_2 = UnitZ(Factor=division_2)  # disabled
move = Move(Geometry=area.Centroid, Motion=Z_2)  # -> Geometry, Transform; disabled
bnd = Bounds(Numbers=area.Area)  # disabled
extr_2 = ExtrudePoint(Base=voronoi, Point=move.Geometry)  # disabled
dedomain = DeconstructDomain(Domain=bnd)  # -> Start, End; disabled
gradient = Gradient(
    LowerLimit=dedomain.Start,
    UpperLimit=dedomain.End,
    Parameter=area.Area,
    stops=[0: RGB(243, 57, 0), 0.1: RGB(236, 27, 60), 0.2: RGB(210, 0, 118), 0.3: RGB(103, 0, 120), 0.4: RGB(39, 72, 161), 0.5: RGB(1, 192, 229), 0.6: RGB(18, 178, 90), 0.7: RGB(79, 186, 8), 0.8: RGB(220, 237, 32), 0.9: RGB(247, 159, 20), 1: RGB(243, 57, 0)])  # disabled
preview_2 = CustomPreview(Geometry=extr_2, Material=gradient)  # disabled

crv_4 = Curve(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)  # disabled
crv_5 = Curve(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)  # disabled
number_slider_12 = Slider(20, range=0..100)  # disabled
number_slider_13 = Slider(7, range=0..20)  # disabled
number_slider_14 = Slider(10, range=0..10)  # disabled
divide = DivideCurve(Curve=crv_4, Count=number_slider_12, Kinks=False)  # -> Points, Tangents, Parameters; disabled
divide_2 = DivideCurve(Curve=crv_5, Count=number_slider_12, Kinks=False)  # -> Points, Tangents, Parameters; disabled
range_2 = Range(Domain=Domain(0, 1), Steps=number_slider_13)  # disabled
ln_2 = Line(StartPoint=divide.Points, EndPoint=divide_2.Points)  # -> graft(Line); disabled
graph = GraphMapper(
    range_2,
    x0=0,
    x1=1,
    y0=0,
    y1=1,
    container_name="Bezier",
    cpx=[0, 0.3202195466, 0.4622594714, 1],
    cpy=[0, 0.9101673365, 0.3411018848, 1])  # disabled
eval_3 = EvaluateCurve(Curve=reparameterize(ln_2), Parameter=graph)  # -> Point, Tangent, Angle; disabled
flip = FlipMatrix(Data=eval_3.Point)  # disabled
intcrv = Interpolate(Vertices=flip, Degree=3, Periodic=False, KnotStyle=1)  # -> flatten(Curve), Length, Domain; disabled
len = Length(Curve=intcrv.Curve)  # disabled
division_3 = Division(A=len, B=number_slider_14)  # disabled
Z_3 = UnitZ(Factor=division_3)  # disabled
extr_3 = Extrude(Base=intcrv.Curve, Direction=Z_3)  # disabled
bnd_2 = Bounds(Numbers=division_3)  # disabled
dedomain_2 = DeconstructDomain(Domain=bnd_2)  # -> Start, End; disabled
gradient_2 = Gradient(
    LowerLimit=dedomain_2.Start,
    UpperLimit=dedomain_2.End,
    Parameter=division_3,
    stops=[0: RGB(0, 98, 0), 0.25: RGB(81, 175, 17), 0.5: RGB(159, 198, 146), 0.75: RGB(170, 235, 41), 1: RGB(221, 255, 53)])  # disabled
preview_3 = CustomPreview(Geometry=extr_3, Material=gradient_2)  # disabled

number_of_branches = Slider(500, range=0..1000)
high_pt = Slider(2335, range=0..16000)
low_pt = Slider(2100, range=0..10000)
high_pt_2 = Slider(1500, range=0..16000)
low_pt_2 = Slider(2300, range=0..10000)
thickness_v = Slider(400, range=0..1000)
thickness_h = Slider(20, range=0..200)
cir = Circle(Plane=PlaneXY(0, 0, 0), Radius=Slider(7300, range=0..100000))
divide_3 = DivideCurve(Curve=cir, Count=number_of_branches, Kinks=False)  # -> Points, Tangents, Parameters
pi = Pi(Factor=Slider(6, range=0..10))
pi_2 = Pi(Factor=Slider(6, range=0..10))
range_3 = Range(Domain=pi, Steps=expr("x-1", number_of_branches))
range_4 = Range(Domain=pi_2, Steps=expr("x-1", number_of_branches))
cos = Cosine(Value=range_3)
cos_2 = Cosine(Value=range_4)
bnd_3 = Bounds(Numbers=cos)
dom_2 = ConstructDomain(DomainStart=high_pt, DomainEnd=low_pt)
bnd_4 = Bounds(Numbers=cos_2)
dom_3 = ConstructDomain(DomainStart=high_pt_2, DomainEnd=low_pt_2)
remap = RemapNumbers(Value=cos, Source=bnd_3, Target=dom_2)  # -> Mapped, Clipped
remap_2 = RemapNumbers(Value=cos_2, Source=bnd_4, Target=dom_3)  # -> Mapped, Clipped
Z_4 = UnitZ(Factor=expr("-x", Slider(2590, range=0..5000)))
Z_5 = UnitZ(Factor=remap.Mapped)
Z_6 = UnitZ(Factor=remap_2.Mapped)
extr_4 = Extrude(Base=cir, Direction=Z_4)
move_2 = Move(Geometry=divide_3.Points, Motion=Z_5)  # -> Geometry, Transform
move_3 = Move(Geometry=divide_3.Points, Motion=Z_6)  # -> Geometry, Transform
merge = Merge(Data1=graft(divide_3.Points), Data2=graft(move_2.Geometry))
merge_2 = Merge(Data1=graft(divide_3.Points), Data2=graft(move_3.Geometry))
pline = PolyLine(Vertices=merge, Closed=False)  # -> flatten(Polyline)
eval_4 = EvaluateCurve(Curve=pline, Parameter=Slider(0.5, range=0..1))  # -> Point, Tangent, Angle
srf_cp = SurfaceClosestPoint(Point=eval_4.Point, Surface=extr_4)  # -> Point, UVPoint, Distance
pline_2 = PolyLine(Vertices=merge_2, Closed=False)  # -> flatten(Polyline)
panel_3 = Panel("""0
1""")
evalsrf = EvaluateSurface(Surface=extr_4, Point=srf_cp.UVPoint)  # -> Point, Normal, UDirection, VDirection, Frame
cull = CullPattern(List=pline, CullPattern=panel_3)
cull_2 = CullPattern(List=pline_2, CullPattern=invert(panel_3))
dispatch = Dispatch(List=evalsrf.Normal, DispatchPattern=panel_3)  # -> ListA, ListB
dispatch_2 = Dispatch(List=evalsrf.Normal, DispatchPattern=panel_3)  # -> ListA, ListB
amp = Amplitude(Vector=dispatch.ListA, Amplitude=thickness_v)
amp_2 = Amplitude(Vector=dispatch_2.ListA, Amplitude=thickness_v)
move_4 = Move(Geometry=cull, Motion=amp)  # -> Geometry, Transform
move_5 = Move(Geometry=cull_2, Motion=expr("-x", amp_2))  # -> Geometry, Transform
rulesrf = RuledSurface(CurveA=graft(move_4.Geometry), CurveB=graft(cull))
rulesrf_2 = RuledSurface(CurveA=graft(move_5.Geometry), CurveB=graft(cull_2))
merge_3 = Merge(Data1=flatten(rulesrf), Data2=flatten(rulesrf_2))
planar = IsPlanar(Surface=merge_3, Interior=True)  # -> Planar, Plane
amp_3 = Amplitude(Vector=planar.Plane, Amplitude=thickness_h)
move_6 = Move(Geometry=merge_3, Motion=amp_3)  # -> Geometry, Transform
extr_5 = Extrude(Base=move_6.Geometry, Direction=expr("-x*2", amp_3))
