# Grasshopper definition 3.21.gh (Grasshopper 1.0.7)

number_slider = Slider(150, range=0..1000)
number_slider_2 = Slider(1500, range=0..10000)
bone_end = Slider(462, range=0..1000)
bone_start = Slider(63, range=0..1000)
spine_length = Slider(5000, range=0..10000)
bone_number = Slider(200, range=0..1000)
bone_end_2 = Slider(550, range=0..1000)
bone_start_2 = Slider(146, range=0..1000)
bone_thickness = Slider(1.7, range=0..10)
thickness_height = Slider(1.2, range=0..5)
spine_end = Slider(55, range=0..100)
spine_start = Slider(7, range=0..100)
multiplication = Multiplication(A=bone_thickness, B=Slider(6.514, range=0..10))
pt = ConstructPoint(XCoordinate=0, YCoordinate=0, ZCoordinate=0)
X = UnitX(Factor=1)
pi = Pi(Factor=Slider(5, range=0..10))
line = LineSDL(Start=pt, Direction=X, Length=spine_length)
range = Range(Domain=pi, Steps=number_slider)
range_2 = Range(Domain=Slider(1500, range=0..10000), Steps=number_slider)
divide = DivideCurve(Curve=line, Count=bone_number, Kinks=False)  # -> Points, Tangents, Parameters
range_3 = Range(Domain=Slider(1, range=0..10), Steps=bone_number)
range_4 = Range(Domain=Slider(1, range=0..10), Steps=bone_number)
range_5 = Range(Domain=Slider(2, range=0..10), Steps=bone_number)
sin = Sine(Value=range)
cos = Cosine(Value=range)
graph = GraphMapper(range_3, x0=0, x1=1, y0=0, y1=1, container_name="Sine", Equation_px=[0, 0.6839273572], Equation_py=[0, 0.9905284643])
graph_2 = GraphMapper(range_4, x0=0, x1=1, y0=0, y1=1, container_name="Sine", Equation_px=[0, 1], Equation_py=[0, 1])
graph_3 = GraphMapper(
    range_5,
    x0=0,
    x1=1,
    y0=0,
    y1=1,
    A=1,
    B=0,
    container_name="Linear",
    Graph_x0=0.25,
    Graph_x1=0.75,
    Graph_y0=0.25,
    Graph_y1=0.75)
area = Area(Geometry=<missing>)  # -> Area, Centroid; disabled
multiplication_2 = Multiplication(A=sin, B=number_slider_2)
multiplication_3 = Multiplication(A=cos, B=number_slider_2)
bnd = Bounds(Numbers=graph)
dom = ConstructDomain(DomainStart=bone_end, DomainEnd=bone_start)
bnd_2 = Bounds(Numbers=graph_2)
dom_2 = ConstructDomain(DomainStart=bone_end_2, DomainEnd=bone_start_2)
bnd_3 = Bounds(Numbers=graph_3)
dom_3 = ConstructDomain(DomainStart=spine_end, DomainEnd=spine_start)
pt_2 = ConstructPoint(XCoordinate=multiplication_2, YCoordinate=multiplication_3, ZCoordinate=range_2)
range_6 = Range(Domain=Domain(0, 1), Steps=number_slider)
remap = RemapNumbers(Value=graph, Source=bnd, Target=dom)  # -> Mapped, Clipped
remap_2 = RemapNumbers(Value=graph_2, Source=bnd_2, Target=dom_2)  # -> Mapped, Clipped
remap_3 = RemapNumbers(Value=graph_3, Source=bnd_3, Target=dom_3)  # -> Mapped, Clipped
graph_4 = GraphMapper(
    range_6,
    x0=0,
    x1=1,
    y0=0,
    y1=1,
    container_name="Sine Summation",
    Equation0_px=[0.1181818172, 0.3090909123],
    Equation0_py=[0.2775330544, 0.4273127913],
    Equation1_px=[0.6121212244, 1],
    Equation1_py=[0.2422907352, 0.4405286312])
Z = UnitZ(Factor=expr("-X", remap.Mapped))
Y = UnitY(Factor=remap_2.Mapped)
Y_2 = UnitY(Factor=remap_3.Mapped)
move = Move(Geometry=divide.Points, Motion=Y_2)  # -> Geometry, Transform
move_2 = Move(Geometry=divide.Points, Motion=Y)  # -> Geometry, Transform
bnd_4 = Bounds(Numbers=graph_4)
dom_4 = ConstructDomain(DomainStart=Slider(0.85, range=0..1), DomainEnd=Slider(1.25, range=0..10))
remap_4 = RemapNumbers(Value=graph_4, Source=bnd_4, Target=dom_4)  # -> Mapped, Clipped
ln = Line(StartPoint=divide.Points, EndPoint=move_2.Geometry)
move_3 = Move(Geometry=move_2.Geometry, Motion=Z)  # -> Geometry, Transform
scale_nu = ScaleNU(Geometry=pt_2, Plane=PlaneXY(0, 0, 0), ScaleX=remap_4.Mapped, ScaleY=remap_4.Mapped, ScaleZ=1)  # -> Geometry, Transform
eval = EvaluateCurve(Curve=ln, Parameter=Slider(0.57, range=0..1))  # -> Point, Tangent, Angle
intcrv = Interpolate(Vertices=scale_nu.Geometry, Degree=3, Periodic=False, KnotStyle=1)  # -> Curve, Length, Domain
merge = Merge(Data1=graft(move.Geometry), Data2=graft(eval.Point), Data3=graft(move_3.Geometry))
intcrv_2 = Interpolate(Vertices=merge, Degree=3, Periodic=False, KnotStyle=1)  # -> Curve, Length, Domain
ln_2 = Line(StartPoint=divide.Points, EndPoint=move.Geometry)
X_2 = UnitX(Factor=bone_thickness)
X_3 = UnitX(Factor=multiplication)
move_4 = Move(Geometry=intcrv_2.Curve, Motion=expr("-X", X_2))  # -> Geometry, Transform
move_5 = Move(Geometry=ln_2, Motion=expr("-X", X_3))  # -> Geometry, Transform
move_6 = Move(Geometry=intcrv_2.Curve, Motion=X_2)  # -> Geometry, Transform
move_7 = Move(Geometry=ln_2, Motion=X_3)  # -> Geometry, Transform
rulesrf = RuledSurface(CurveA=move_6.Geometry, CurveB=move_4.Geometry)
rulesrf_2 = RuledSurface(CurveA=move_7.Geometry, CurveB=move_5.Geometry)
xz = XZPlane(Origin=Point(0, 0, 0))
planar = IsPlanar(Surface=rulesrf, Interior=True)  # -> Planar, Plane; disabled
mirror = Mirror(Geometry=rulesrf, Plane=xz)  # -> Geometry, Transform
mirror_2 = Mirror(Geometry=rulesrf_2, Plane=xz)  # -> Geometry, Transform
amp = Amplitude(Vector=planar.Plane, Amplitude=thickness_height)  # disabled
move_8 = Move(Geometry=rulesrf, Motion=amp)  # -> Geometry, Transform; disabled
extr = Extrude(Base=move_8.Geometry, Direction=expr("-x*2", amp))  # disabled
