# Grasshopper definition 3211111.gh (Grasshopper 1.0.7)

panel = Panel("SPINE")
number_slider = Slider(10, range=0..10)  # disabled
number_slider_2 = Slider(100, range=0..100)  # disabled
panel_2 = Panel("H")
panel_3 = Panel("V")
number_slider_3 = Slider(1, range=0..10)
bone_end = Slider(46, range=0..200)
number_slider_4 = Slider(1500, range=0..10000)
number_slider_5 = Slider(0.3, range=0..1)
bone_number = Slider(600, range=0..1000)
bone_thickness_h = Slider(10, range=0..100)
number_slider_6 = Slider(1, range=0..10)
bone_end_2 = Slider(296, range=0..1000)
bone_start = Slider(150, range=0..1000)
number_slider_7 = Slider(1, range=0..10)
bone_end_3 = Slider(71, range=0..1000)
bone_start_2 = Slider(46, range=0..1000)
bone_start_3 = Slider(16, range=0..200)
bone_end_4 = Slider(462, range=0..1000)
bone_start_4 = Slider(63, range=0..1000)
spine_length = Slider(5000, range=0..10000)
bone_number_2 = Slider(200, range=0..1000)
bone_end_5 = Slider(550, range=0..1000)
bone_start_5 = Slider(146, range=0..1000)
bone_thickness = Slider(1.7, range=0..10)
thickness_height = Slider(1.2, range=0..5)
spine_end = Slider(55, range=0..100)
spine_start = Slider(7, range=0..100)
panel_4 = Panel("BASE CURVE")
dom = ConstructDomain(DomainStart=number_slider, DomainEnd=number_slider_2)  # disabled
number_slider_8 = Slider(10, range=0..100)  # disabled
crv = Curve(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)  # disabled
multiplication = Multiplication(A=bone_thickness, B=Slider(6.514, range=0..10))
pt = ConstructPoint(XCoordinate=0, YCoordinate=0, ZCoordinate=0)
multiplication_2 = Multiplication(A=bone_thickness_h, B=Slider(2.07, range=0..10))
X = UnitX(Factor=1)
range = Range(Domain=dom, Steps=number_slider_8)  # disabled
pi = Pi(Factor=Slider(5, range=0..10))
line = LineSDL(Start=pt, Direction=X, Length=spine_length)
panel_5 = Panel(range)  # disabled
range_2 = Range(Domain=pi, Steps=bone_number)
range_3 = Range(Domain=Slider(1500, range=0..10000), Steps=bone_number)
divide = DivideCurve(Curve=line, Count=bone_number_2, Kinks=False)  # -> Points, Tangents, Parameters
range_4 = Range(Domain=Slider(1, range=0..10), Steps=bone_number_2)
range_5 = Range(Domain=Slider(1, range=0..10), Steps=bone_number_2)
range_6 = Range(Domain=Slider(2, range=0..10), Steps=bone_number_2)
sin = Sine(Value=range_2)
cos = Cosine(Value=range_2)
graph = GraphMapper(range_4, x0=0, x1=1, y0=0, y1=1, container_name="Sine", Equation_px=[0, 0.6839273572], Equation_py=[0, 0.9905284643])
graph_2 = GraphMapper(range_5, x0=0, x1=1, y0=0, y1=1, container_name="Sine", Equation_px=[0, 1], Equation_py=[0, 1])
graph_3 = GraphMapper(
    range_6,
    x0=0,
    x1=1,
    y0=0,
    y1=1,
    A=1,
    B=0,
    container_name="Linear",
    Graph_x0=0.25,
    Graph_x1=0.75,
    Graph_y0=0.25,
    Graph_y1=0.75)
Z = UnitZ(Factor=range)  # disabled
multiplication_3 = Multiplication(A=sin, B=number_slider_4)
multiplication_4 = Multiplication(A=cos, B=number_slider_4)
bnd = Bounds(Numbers=graph)
dom_2 = ConstructDomain(DomainStart=bone_end_4, DomainEnd=bone_start_4)
bnd_2 = Bounds(Numbers=graph_2)
dom_3 = ConstructDomain(DomainStart=bone_end_5, DomainEnd=bone_start_5)
bnd_3 = Bounds(Numbers=graph_3)
dom_4 = ConstructDomain(DomainStart=spine_end, DomainEnd=spine_start)
move = Move(Geometry=crv, Motion=Z)  # -> Geometry, Transform; disabled
pt_2 = ConstructPoint(XCoordinate=multiplication_3, YCoordinate=multiplication_4, ZCoordinate=range_3)
range_7 = Range(Domain=Domain(0, 1), Steps=bone_number)
remap = RemapNumbers(Value=graph, Source=bnd, Target=dom_2)  # -> Mapped, Clipped
remap_2 = RemapNumbers(Value=graph_2, Source=bnd_2, Target=dom_3)  # -> Mapped, Clipped
remap_3 = RemapNumbers(Value=graph_3, Source=bnd_3, Target=dom_4)  # -> Mapped, Clipped
graph_4 = GraphMapper(
    range_7,
    x0=0,
    x1=1,
    y0=0,
    y1=1,
    container_name="Sine Summation",
    Equation0_px=[0.1181818172, 0.3090909123],
    Equation0_py=[0.2775330544, 0.4273127913],
    Equation1_px=[0.6121212244, 1],
    Equation1_py=[0.2422907352, 0.4405286312])
Z_2 = UnitZ(Factor=expr("-X", remap.Mapped))
Y = UnitY(Factor=remap_2.Mapped)
Y_2 = UnitY(Factor=remap_3.Mapped)
range_8 = Range(Domain=Domain(0, 1), Steps=number_slider_8)  # disabled
move_2 = Move(Geometry=divide.Points, Motion=Y_2)  # -> Geometry, Transform
move_3 = Move(Geometry=divide.Points, Motion=Y)  # -> Geometry, Transform
end = EndPoints(Curve=move.Geometry)  # -> Start, End; disabled
graph_5 = GraphMapper(
    range_8,
    x0=0,
    x1=1,
    y0=0,
    y1=1,
    Ox=0.5241549015,
    Oy=0.2487916946,
    Px=0.7256461382,
    Py=0.3239074349,
    container_name="Parabola")  # disabled
bnd_4 = Bounds(Numbers=graph_4)
dom_5 = ConstructDomain(DomainStart=Slider(0.85, range=0..1), DomainEnd=Slider(1.25, range=0..10))
ln = Line(StartPoint=divide.Points, EndPoint=move_3.Geometry)
remap_4 = RemapNumbers(Value=graph_4, Source=bnd_4, Target=dom_5)  # -> Mapped, Clipped
move_4 = Move(Geometry=move_3.Geometry, Motion=Z_2)  # -> Geometry, Transform
eval = EvaluateCurve(Curve=ln, Parameter=Slider(0.57, range=0..1))  # -> Point, Tangent, Angle
number_slider_9 = Slider(2, range=0..10)  # disabled
scale_nu = ScaleNU(Geometry=pt_2, Plane=PlaneXY(0, 0, 0), ScaleX=remap_4.Mapped, ScaleY=remap_4.Mapped, ScaleZ=1)  # -> Geometry, Transform
merge = Merge(Data1=graft(move_2.Geometry), Data2=graft(eval.Point), Data3=graft(move_4.Geometry))
scale = Scale(Geometry=move.Geometry, Center=end.End, Factor=expr("x+0.01", graph_5))  # -> Geometry, Transform; disabled
intcrv = Interpolate(Vertices=merge, Degree=3, Periodic=False, KnotStyle=1)  # -> Curve, Length, Domain
ln_2 = Line(StartPoint=divide.Points, EndPoint=move_2.Geometry)
X_2 = UnitX(Factor=bone_thickness)
X_3 = UnitX(Factor=multiplication)
division = Division(A=graph_5, B=number_slider_9)  # disabled
move_5 = Move(Geometry=intcrv.Curve, Motion=expr("-X", X_2))  # -> Geometry, Transform
move_6 = Move(Geometry=ln_2, Motion=expr("-X", X_3))  # -> Geometry, Transform
move_7 = Move(Geometry=intcrv.Curve, Motion=X_2)  # -> Geometry, Transform
move_8 = Move(Geometry=ln_2, Motion=X_3)  # -> Geometry, Transform
pdecon = Deconstruct(Point=scale_nu.Geometry)  # -> XComponent, YComponent, ZComponent
rotate = Rotate(Geometry=scale.Geometry, Angle=degrees(division), Plane=PlaneXY(0, 0, 0))  # -> Geometry, Transform; disabled
rulesrf = RuledSurface(CurveA=move_7.Geometry, CurveB=move_5.Geometry)
rulesrf_2 = RuledSurface(CurveA=move_8.Geometry, CurveB=move_6.Geometry)
number_slider_10 = Slider(10, range=0..10)  # disabled
number_slider_11 = Slider(10, range=0..10)  # disabled
loft = Loft(Curves=rotate.Geometry, Options={Adjust=False, Closed=False, LoftEnds=0, LoftSimp=0, LoftType=0, Rebuild=10, Refit=0.01})  # disabled
xz = XZPlane(Origin=Point(0, 0, 0))
range_9 = Range(Domain=number_slider_6, Steps=bone_number)
range_10 = Range(Domain=number_slider_6, Steps=bone_number)
graph_6 = GraphMapper(range_9, x0=0, x1=1, y0=0, y1=1, container_name="Sine", Equation_px=[0, 1], Equation_py=[0, 1])
graph_7 = GraphMapper(range_10, x0=0, x1=1, y0=0, y1=1, container_name="Sine", Equation_px=[0, 1], Equation_py=[0, 1])
number_slider_12 = Slider(4, range=0..10)  # disabled
mirror = Mirror(Geometry=rulesrf, Plane=xz)  # -> Geometry, Transform
mirror_2 = Mirror(Geometry=rulesrf_2, Plane=xz)  # -> Geometry, Transform
divide_2 = DivideDomain²(Domain=loft, UCount=number_slider_10, VCount=number_slider_11)  # disabled
range_11 = Range(Domain=number_slider_3, Steps=bone_number)
range_12 = Range(Domain=number_slider_3, Steps=bone_number)
bnd_5 = Bounds(Numbers=graph_6)
bnd_6 = Bounds(Numbers=graph_7)
dom_6 = ConstructDomain(DomainStart=bone_end_2, DomainEnd=bone_start)
dom_7 = ConstructDomain(DomainStart=bone_end_2, DomainEnd=bone_start)
graph_8 = GraphMapper(range_11, x0=0, x1=1, y0=0, y1=1, container_name="Sine", Equation_px=[0, 0.6978130937], Equation_py=[0, 0.9897172451])
graph_9 = GraphMapper(range_12, x0=0, x1=1, y0=0, y1=1, container_name="Sine", Equation_px=[0, 0.6978130937], Equation_py=[0, 0.9897172451])
range_13 = Range(Domain=number_slider_7, Steps=bone_number)
range_14 = Range(Domain=number_slider_7, Steps=bone_number)
remap_5 = RemapNumbers(Value=graph_6, Source=bnd_5, Target=dom_6)  # -> Mapped, Clipped
remap_6 = RemapNumbers(Value=graph_7, Source=bnd_6, Target=dom_7)  # -> Mapped, Clipped
sbox = SurfaceBox(Surface=loft, Domain=divide_2, Height=number_slider_12)  # disabled
graph_10 = GraphMapper(range_13, x0=0, x1=1, y0=0, y1=1, container_name="Sine", Equation_px=[0, 0.9971202612], Equation_py=[0, 1])
graph_11 = GraphMapper(range_14, x0=0, x1=1, y0=0, y1=1, container_name="Sine", Equation_px=[0, 1], Equation_py=[0, 1])
amp = Amplitude(Vector=scale_nu.Geometry, Amplitude=expr("-x", remap_6.Mapped))
bnd_7 = Bounds(Numbers=graph_8)
dom_8 = ConstructDomain(DomainStart=bone_end, DomainEnd=bone_start_3)
bnd_8 = Bounds(Numbers=graph_9)
dom_9 = ConstructDomain(DomainStart=bone_end, DomainEnd=bone_start_3)
amp_2 = Amplitude(Vector=scale_nu.Geometry, Amplitude=remap_5.Mapped)
geo = Geometry(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)  # disabled
remap_7 = RemapNumbers(Value=graph_8, Source=bnd_7, Target=dom_8)  # -> Mapped, Clipped
remap_8 = RemapNumbers(Value=graph_9, Source=bnd_8, Target=dom_9)  # -> Mapped, Clipped
move_9 = Move(Geometry=scale_nu.Geometry, Motion=amp_2)  # -> Geometry, Transform
move_10 = Move(Geometry=scale_nu.Geometry, Motion=amp)  # -> Geometry, Transform
bnd_9 = Bounds(Numbers=graph_10)
dom_10 = ConstructDomain(DomainStart=bone_end_3, DomainEnd=bone_start_2)
bnd_10 = Bounds(Numbers=graph_11)
dom_11 = ConstructDomain(DomainStart=bone_end_3, DomainEnd=bone_start_2)
bbox = BoundingBox(Content=geo, Plane=PlaneXY(0, 0, 0))  # -> Box, Box_2; disabled
planar = IsPlanar(Surface=rulesrf, Interior=True)  # -> Planar, Plane
amp_3 = Amplitude(Vector=scale_nu.Geometry, Amplitude=expr("-X", remap_7.Mapped))
amp_4 = Amplitude(Vector=scale_nu.Geometry, Amplitude=remap_8.Mapped)
remap_9 = RemapNumbers(Value=graph_10, Source=bnd_9, Target=dom_10)  # -> Mapped, Clipped
remap_10 = RemapNumbers(Value=graph_11, Source=bnd_10, Target=dom_11)  # -> Mapped, Clipped
pdecon_2 = Deconstruct(Point=move_9.Geometry)  # -> XComponent, YComponent, ZComponent
pdecon_3 = Deconstruct(Point=move_10.Geometry)  # -> XComponent, YComponent, ZComponent
amp_5 = Amplitude(Vector=planar.Plane, Amplitude=thickness_height)
morph = BoxMorph(Geometry=geo, Reference=bbox.Box, Target=sbox)  # disabled
move_11 = Move(Geometry=scale_nu.Geometry, Motion=amp_3)  # -> Geometry, Transform
move_12 = Move(Geometry=scale_nu.Geometry, Motion=amp_4)  # -> Geometry, Transform
Z_3 = UnitZ(Factor=expr("-x", remap_9.Mapped))
Z_4 = UnitZ(Factor=expr("-x", remap_10.Mapped))
move_13 = Move(Geometry=rulesrf, Motion=amp_5)  # -> Geometry, Transform
pt_3 = ConstructPoint(XCoordinate=pdecon_2.XComponent, YCoordinate=pdecon_2.YComponent, ZCoordinate=pdecon.ZComponent)
pt_4 = ConstructPoint(XCoordinate=pdecon_3.XComponent, YCoordinate=pdecon_3.YComponent, ZCoordinate=pdecon.ZComponent)
ln_3 = Line(StartPoint=scale_nu.Geometry, EndPoint=pt_3)
ln_4 = Line(StartPoint=scale_nu.Geometry, EndPoint=pt_4)
pdecon_4 = Deconstruct(Point=move_11.Geometry)  # -> XComponent, YComponent, ZComponent
pdecon_5 = Deconstruct(Point=move_12.Geometry)  # -> XComponent, YComponent, ZComponent
extr = Extrude(Base=move_13.Geometry, Direction=expr("-x*2", amp_5))
Z_5 = UnitZ(Factor=Slider(5, range=0..10))
pt_5 = ConstructPoint(XCoordinate=pdecon_4.XComponent, YCoordinate=pdecon_4.YComponent, ZCoordinate=pdecon.ZComponent)
pt_6 = ConstructPoint(XCoordinate=pdecon_5.XComponent, YCoordinate=pdecon_5.YComponent, ZCoordinate=pdecon.ZComponent)
move_14 = Move(Geometry=scale_nu.Geometry, Motion=Z_5)  # -> Geometry, Transform
move_15 = Move(Geometry=pt_3, Motion=Z_3)  # -> Geometry, Transform
move_16 = Move(Geometry=pt_4, Motion=Z_4)  # -> Geometry, Transform
eval_2 = EvaluateCurve(Curve=ln_3, Parameter=number_slider_5)  # -> Point, Tangent, Angle
eval_3 = EvaluateCurve(Curve=ln_4, Parameter=number_slider_5)  # -> Point, Tangent, Angle
merge_2 = Merge(Data1=graft(pt_5), Data2=graft(move_14.Geometry), Data3=graft(pt_6))
intcrv_2 = Interpolate(Vertices=merge_2, Degree=3, Periodic=False, KnotStyle=1)  # -> Curve, Length, Domain
merge_3 = Merge(Data1=graft(pt_6), Data2=graft(eval_2.Point), Data3=graft(move_15.Geometry))
merge_4 = Merge(Data1=graft(pt_5), Data2=graft(eval_3.Point), Data3=graft(move_16.Geometry))
intcrv_3 = Interpolate(Vertices=merge_3, Degree=3, Periodic=False, KnotStyle=1)  # -> Curve, Length, Domain
intcrv_4 = Interpolate(Vertices=merge_4, Degree=3, Periodic=False, KnotStyle=1)  # -> Curve, Length, Domain
amp_6 = Amplitude(Vector=intcrv_3.Curve, Amplitude=expr("-x", multiplication_2))
amp_7 = Amplitude(Vector=intcrv_3.Curve, Amplitude=multiplication_2)
move_17 = Move(Geometry=intcrv_2.Curve, Motion=amp_7)  # -> Geometry, Transform
move_18 = Move(Geometry=intcrv_2.Curve, Motion=amp_6)  # -> Geometry, Transform
amp_8 = Amplitude(Vector=intcrv_3.Curve, Amplitude=expr("-x", bone_thickness_h))
amp_9 = Amplitude(Vector=intcrv_3.Curve, Amplitude=expr("-x", bone_thickness_h))
amp_10 = Amplitude(Vector=intcrv_3.Curve, Amplitude=bone_thickness_h)
amp_11 = Amplitude(Vector=intcrv_3.Curve, Amplitude=bone_thickness_h)
rulesrf_3 = RuledSurface(CurveA=move_17.Geometry, CurveB=move_18.Geometry)
move_19 = Move(Geometry=intcrv_3.Curve, Motion=amp_10)  # -> Geometry, Transform
move_20 = Move(Geometry=intcrv_3.Curve, Motion=amp_8)  # -> Geometry, Transform
move_21 = Move(Geometry=intcrv_4.Curve, Motion=amp_11)  # -> Geometry, Transform
move_22 = Move(Geometry=intcrv_4.Curve, Motion=amp_9)  # -> Geometry, Transform
rulesrf_4 = RuledSurface(CurveA=move_19.Geometry, CurveB=move_20.Geometry)
rulesrf_5 = RuledSurface(CurveA=move_21.Geometry, CurveB=move_22.Geometry)
preview = CustomPreview(Geometry=rulesrf_3, Material=ColourSwatch(SwatchColor=RGBA(255, 255, 255, 73)))
preview_2 = CustomPreview(Geometry=rulesrf_4, Material=ColourSwatch(SwatchColor=RGBA(255, 255, 255, 73)))
preview_3 = CustomPreview(Geometry=rulesrf_5, Material=ColourSwatch(SwatchColor=RGBA(255, 255, 255, 73)))
