# Grasshopper definition 9 9.gh (Grasshopper 1.0.7)
# plug-ins: Human, Kangaroo2 Components

panel = Panel("Point")  # disabled
panel_2 = Panel("Layer 01")  # disabled
mplane = MeshPlane(Boundary={Plane=PlaneXY(0, 0, 0), Size=Domain2(u=-10..10, v=-10..10)}, WidthCount=30, HeightCount=30)  # -> Mesh, Area
pt = Point([Point(-9.086691645, 9.426467246, 0), Point(8.794726224, 8.581259902, 0), Point(8.741900765, -9.14168159, 0), Point(-9.033866186, -8.851141565, 0)])
demesh = DeconstructMesh(Mesh=mplane.Mesh)  # -> Vertices, Faces, Colours, Normals
faceb = FaceBoundaries(Mesh=mplane.Mesh)
dpipeline = DynamicGeometryPipeline(
    LayerFilter=panel_2,
    TypeFilter=panel,
    NameFilter="*",
    GroupByLayer=False,
    GroupByType=False,
    IncludeHidden=True,
    IncludeLocked=True,
    enableFullPath=False,
    listenToAttributes=True)  # disabled
cp = ClosestPoint(Point=pt, Cloud=demesh.Vertices)  # -> ClosestPoint, CPIndex, Distance
edgelengths = EdgeLengths(Mesh=mplane.Mesh, LengthFactor=Slider(0, range=0..1), Strength=1)
del = DelaunayMesh(Points=dpipeline, Plane=PlaneXY(0, 0, 0))  # disabled
anchor = Anchor(Point=cp.ClosestPoint, Strength=10000)
load = Load(Point=demesh.Vertices, ForceVector=Vector(0, 0, 1), Weighting=1)
pressure = Pressure(M=mplane.Mesh, Strength=1)
toggle = BooleanToggle(True)  # disabled
button = Button()  # disabled
solver = Solver(GoalObjects=edgelengths, Reset=button, Threshold=1e-15, Tolerance=0.0001, On=toggle)  # -> I, V, O; disabled
merge = Merge(Data1=edgelengths, Data2=anchor, Data3=load)
stepsolver = StepSolver(
    GoalObjects=flatten(merge),
    Tolerance=0.0001,
    Momentum=False,
    Damping=0.99,
    SubIterations="1",
    Animate=Slider(27, range=0..100))  # -> I, V, O
